# Grasshopper definition bibil_acadia_22_minimal.gh (Grasshopper 0.9.76)
# plug-ins: Python Interpreter, HDTReference

list = ValueList({"dir", "file"}, selected="dir")

# ---- group: find directory
bibil = PythonScript(
    dir=["C:\\Users\\vasanthakumars\\Documents\\GitHub\\bibil\\src", "C:\\saeran\\master\\git\\bibil\\src"],
    type=list,
    run=Toggle(True))  # -> dir; inputs dir: list
# ---------- bibil: Python ----------
import os
import sys

ghenv.Component.Params.Output[0].Name = "null"
ghenv.Component.Params.Output[0].NickName = "null"

#sys.path.append("C:\Program Files\Rhinoceros 5.0 (64-bit)\System")

if run:
    confirm_dir = None
    for d in dir:
        try:
            if type == "file":
                file_ = open(d)
                file_.close()
            else:
                print os.listdir(d)
            confirm_dir = d
            break
        except Exception as e:
            #print str(e)
            continue
    if confirm_dir != None:
        ghenv.Component.Params.Output[0].Name = type
        ghenv.Component.Params.Output[0].NickName = type
        dir = confirm_dir
        file = confirm_dir
null = None
# ---------- end bibil ----------

# ---- group: node_bucket
python_script = PythonScript(i=bibil)  # -> o
# ---------- python_script: Python ----------
import os

if i:
    o = os.path.join(str(i),"miru\\miru_shape_bucket.py")
# ---------- end python_script ----------
file = ReadFile(File=python_script, PerLineParse=False)

# ---- group: tree
python_script_2 = PythonScript(i=bibil)  # -> o
# ---------- python_script_2: Python ----------
import os

if i:
    o = os.path.join(str(i),"bibil\\bibil_tree.py")
# ---------- end python_script_2 ----------
file_2 = ReadFile(File=python_script_2, PerLineParse=False)
bibil_2 = PythonScript(Code=file_2)

# ---- group: grammar
python_script_3 = PythonScript(i=bibil)  # -> o
# ---------- python_script_3: Python ----------
import os

if i:
    o = os.path.join(str(i),"bibil\\bibil_grammar.py")
# ---------- end python_script_3 ----------
file_3 = ReadFile(File=python_script_3, PerLineParse=False)
bibil_3 = PythonScript(Code=file_3)

# ---- group: shape
python_script_4 = PythonScript(i=bibil)  # -> o
# ---------- python_script_4: Python ----------
import os

if i:
    o = os.path.join(str(i),"bibil\\bibil_shape.py")
#o = os.path.join(str(i),"research\\bibil_shape_shape_3d_2d.py")
# ---------- end python_script_4 ----------
file_4 = ReadFile(File=python_script_4, PerLineParse=False)
bibil_4 = PythonScript(Code=file_4)

# ---- group: bula
python_script_5 = PythonScript(i=bibil)  # -> o
# ---------- python_script_5: Python ----------
import os

if i:
    o = os.path.join(str(i),"bula\\bula_minimal.py")
# ---------- end python_script_5 ----------
file_5 = ReadFile(File=python_script_5, PerLineParse=False)
bibil_5 = PythonScript(Code=file_5)

# ---- group: UI
python_script_6 = PythonScript(i=bibil)  # -> o
# ---------- python_script_6: Python ----------
import os

if i:
    o = os.path.join(str(i),"bibil\\bibil_UI.py")
# ---------- end python_script_6 ----------
file_6 = ReadFile(File=python_script_6, PerLineParse=False)

# ---- group: grammar_divide
python_script_7 = PythonScript(i=bibil)  # -> o
# ---------- python_script_7: Python ----------
import os

if i:
    o = os.path.join(str(i),"miru\\miru_divide.py")
# ---------- end python_script_7 ----------
file_7 = ReadFile(File=python_script_7, PerLineParse=False)

# ---- group: grammar_courtyard
python_script_8 = PythonScript(i=bibil)  # -> o
# ---------- python_script_8: Python ----------
import os

if i:
    o = os.path.join(str(i),"miru\\miru_court.py")
# ---------- end python_script_8 ----------
file_8 = ReadFile(File=python_script_8, PerLineParse=False)

# ---- group: grammar_tower
python_script_9 = PythonScript(i=bibil)  # -> o
# ---------- python_script_9: Python ----------
import os

if i:
    o = os.path.join(str(i),"miru\\miru_packing.py")
# ---------- end python_script_9 ----------
file_9 = ReadFile(File=python_script_9, PerLineParse=False)

# ---- group: stepback
python_script_10 = PythonScript(i=bibil)  # -> o
# ---------- python_script_10: Python ----------
import os

if i:
    o = os.path.join(str(i),"miru\\miru_stepback.py")
# ---------- end python_script_10 ----------
file_10 = ReadFile(File=python_script_10, PerLineParse=False)

# ---- group: grammar_height
python_script_11 = PythonScript(i=bibil)  # -> o
# ---------- python_script_11: Python ----------
import os

if i:
    o = os.path.join(str(i),"miru\\miru_height.py")
# ---------- end python_script_11 ----------
file_11 = ReadFile(File=python_script_11, PerLineParse=False)

# ---- group: grammar_analysis_pts
python_script_12 = PythonScript(i=bibil)  # -> o
# ---------- python_script_12: Python ----------
import os

if i:
    o = os.path.join(str(i),"miru\\miru_analysis.py")
# ---------- end python_script_12 ----------
file_12 = ReadFile(File=python_script_12, PerLineParse=False)

# ---- group: meta_tree
python_script_13 = PythonScript(i=bibil)  # -> o
# ---------- python_script_13: Python ----------
import os

if i:
    o = os.path.join(str(i),"miru\\miru_meta_tree.py")
# ---------- end python_script_13 ----------
file_13 = ReadFile(File=python_script_13, PerLineParse=False)

# ---- group: land_use
python_script_14 = PythonScript(i=bibil)  # -> o
# ---------- python_script_14: Python ----------
import os

if i:
    o = os.path.join(str(i),"miru\\miru_landuse.py")
# ---------- end python_script_14 ----------
file_14 = ReadFile(File=python_script_14, PerLineParse=False)

# ---- group: shape2height
python_script_15 = PythonScript(i=bibil)  # -> o
# ---------- python_script_15: Python ----------
import os

if i:
    o = os.path.join(str(i),"miru\\miru_shape2height.py")
# ---------- end python_script_15 ----------
file_15 = ReadFile(File=python_script_15, PerLineParse=False)

# ---- group: extract_slice
python_script_16 = PythonScript(i=bibil)  # -> o
# ---------- python_script_16: Python ----------
import os

if i:
    o = os.path.join(str(i),"miru\\miru_extract_slice.py")
# ---------- end python_script_16 ----------
file_16 = ReadFile(File=python_script_16, PerLineParse=False)

# ----
list_2 = ValueList({"divide by depth": "subdivide_depth", "divide by same depth": "subdivide_depth_same", "divide by dim": "subdivide_dim"}, selected="divide by same depth")
list_3 = ValueList({"YZ": "NS", "XZ": "EW", "XY": "Z"}, selected="XZ")

# ---- group: ENERGY_MODEL_BUCKET
miru = PythonScript(Code=file, Run=Toggle(True))

# ---- group: SETBACK
miru_2 = PythonScript(Code=file_10, Height_stepback="22.5:6.0", Run=Toggle(False))

# ---- group: PACKING
separatedata = Ladybug_SeparateData(Code=file_9, X_keep_omit="27.0,25.0", Y_keep_omit="27.0,25.0", Seperation_ref="-1", Run=Toggle(False))

# ---- group: EXTRACT_SLICE
miru_3 = PythonScript(Code=file_16, Run=Toggle(False))

# ---- group: DIVIDE
miru_4 = PythonScript(
    Code=file_7,
    Divide_num=Slider(2, range=0..10),
    Divide_cut=Slider(0, range=0..100),
    Divide_type=list_2,
    Divide_ratio=Slider(0.5, range=0..1),
    Axis=list_3,
    Run=Toggle(False))

# ---- group: PERIMETER
miru_5 = PythonScript(Code=file_8, Width=Slider(20, range=0..100), Cut_width=Slider(0, range=0..100), Court_ref="0", Run=Toggle(False))

# ---- group: HEIGHT
miru_6 = PythonScript(Code=file_11, Height=Slider(16.5, range=0..100), Run=Toggle(True))

# ---- group: TREE RULES
miru_7 = PythonScript(Code=file_13, Run=Toggle(False))

# ---- group: SHAPE2HEIGHT
miru_8 = PythonScript(Code=file_15, Run=Toggle(False))

# ----
geo = Geometry([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])
geo_2 = Geometry([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])
geo_3 = Geometry([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])

# ---- group: META-RES
bibil_6 = PythonScript(Code=file_6, Node_in=flatten(geo_2), Label_="ResRoot", Run=Toggle(True))  # -> Node_out, Debug

# ---- group: META-COM
bibil_7 = PythonScript(Code=file_6, Node_in=flatten(geo_3), Label_="ComRoot", Run=Toggle(True))  # -> Node_out, Debug

# ----
bibil_8 = PythonScript(Code=file_6, Node_in=flatten(geo), Label_="d10", Run=Toggle(True))  # -> Node_out, Debug
data = Data([bibil_6.Node_out, bibil_7.Node_out])

# ---- group: DENSITY_UNIFORMITY
number_slider = Slider(0, range=0..4)

# ---- group: SET/STEPBACK
number_slider_2 = Slider(1, range=0..6, expression="x*0.75")

# ---- group: PODIUM HEIGHT
number_slider_3 = Slider(5, range=0..8, expression="(x*3) + 7.5")

# ----
python = PythonScript(init_zones=data, init_nodes=bibil_8.Node_out, run=Toggle(True))  # -> res_node, com_node; inputs init_zones: list, init_nodes: list
# ---------- python: Python ----------
import random
import scriptcontext as sc
import Rhino as rc
import rhinoscriptsyntax as rs

import Grasshopper
import Grasshopper.Kernel as gh
import scriptcontext as sc
ghenv.Component.Message = 'Bibil_1'

Bula = sc.sticky['Bula']
Grammar = sc.sticky['Grammar']
sc.sticky['GLOBAL_COLLISION_LIST'] = []

def normalize_all_heights(raw_nodes):
    D={}
    max = raw_nodes[0].shape.ht
    min = raw_nodes[0].shape.ht
    htlst = []
    for i in xrange(len(raw_nodes)):
        ht = raw_nodes[i].shape.ht
        if ht>max:
            max = ht
        if ht<min:
            min = ht
        htlst.append(ht)
    #max and min heights
    normlst = B.normalize_list(htlst,91.5,10.5)
    map(lambda nh: nh[0].shape.op_extrude(nh[1]),zip(raw_nodes,normlst))
    return raw_nodes
def set_parcel_by_zone(parcel_,zone_):
    L = []
    cpt = parcel_.shape.cpt
    for j in xrange(len(zone_)):
        zonecrv = zone_[j]
        #debug.append(zonecrv)
        IsIn = rs.PointInPlanarClosedCurve(cpt,zonecrv)
        if IsIn>0.5:
            IsDefined = True
            #debug.append(parcel)
            L.append(parcel_)
            break
    return L

if run:
    B = Bula()
    G = Grammar()
    # Normalize all heights
    norm_nodes = normalize_all_heights(init_nodes)
    
    # Sort the parcels by res/com boundaries
    # There needs to be a better spatial partiioning algorithm to do this part
    # Time complexity = O(2m) + O(4n)
    
    res_zones = []
    res_parcels,com_parcels = [],[]
    
    for i in xrange(len(init_zones)):
        zone = init_zones[i]
        if 'res' in zone.grammar.type['label'].lower():
            res_zones.append(zone.shape.bottom_crv)
            
    for i in xrange(len(norm_nodes)):
        norm = norm_nodes[i]
        IsInRes = set_parcel_by_zone(norm,res_zones)
        if IsInRes:
            res_parcels.append(norm)
        else:
            com_parcels.append(norm)
    
    zone_lst = [res_parcels, com_parcels]
    
    # Bucket according to density label
    bucket_dict = {"apply2list":True, "keys2bucket":["label"],\
                    "fx2bucket":"lambda n:n.grammar.type['label']"}
    for i in xrange(len(zone_lst)):
        nodesbytype = zone_lst[i]
        bucketed_lst = G.bucket_shape(nodesbytype,bucket_dict)
        nestedbylabel = bucketed_lst[0]
        nestedbylabel.sort(key=lambda tple:tple[0])
        zone_lst[i] = map(lambda l:l[1],nestedbylabel)
    
    res_node = zone_lst[0]
    com_node = zone_lst[1]
# ---------- end python ----------
# ZONING BOUNDARIES
g = PythonScript(node=python.res_node)  # -> flatgeom; inputs node: list
# ---------- g: Python ----------
if type(node[0])==type([]):node = reduce(lambda x,y: x+y,node)
node = filter(lambda n: n!=None,node)
geom = []
if node and node != []:
    for n in node:
        geom.append(n.shape.geom)
flatgeom=geom
# ---------- end g ----------
g_2 = PythonScript(node=python.com_node)  # -> flatgeom; inputs node: list
# ---------- g_2: Python ----------
if node and node != []:
    if type(node[0])==type([]):node = reduce(lambda x,y: x+y,node)
    node = filter(lambda n: n!=None,node)
    geom = []
    for n in node:
        geom.append(n.shape.geom)
    flatgeom=geom
# ---------- end g_2 ----------
fly = Ladybug_fly(inputSliders=[number_slider, number_slider_3, number_slider_2], fly=Toggle(False))  # -> Vviiiiiiiiiizzz; plug-in component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

# ---- group: GLOBAL COLLISION
python_2 = PythonScript(reset=Toggle(True))  # -> o
# ---------- python_2: Python ----------
import scriptcontext as sc


if reset!=None: 
    sc.sticky['GLOBAL_COLLISION_LIST'] = []

o = sc.sticky['GLOBAL_COLLISION_LIST']
print o
# ---------- end python_2 ----------

# ----
python_3 = PythonScript(run=Toggle(True))  # -> o
# ---------- python_3: Python ----------
import scriptcontext as sc

if run:
    sc.sticky['counter'] = 0.
# ---------- end python_3 ----------

# ---- group: TRIGGER
data_2 = Data(number_slider_2)

# ---- group: RECOMPUTE
resetsol = PythonScript(reset=data_2)  # -> o; disabled
# ---------- resetsol: Python ----------
"""----------------
Miru Recompute Solution
----------------""" 

import Grasshopper
import Grasshopper.Kernel as gh
import scriptcontext as sc
ghenv.Component.Message = 'Recompute_Soln'



## This is a refence right now, must copy and paste 
## into ghcomponent to work

if reset:
    
    document = ghenv.Component.OnPingDocument()
    
    objects = list(document.Objects)
    for obj in objects:
        #get the ghpython components
        if type(obj)!= type(ghenv.Component):
            pass
        else:
            chk_bug = obj.Name!=None and "Ladybug" in obj.Name
            chk_self = obj.Message!=None and "Recompute_Soln" in obj.Message
            chk_bibil = obj.Message!=None and "Bibil" in obj.Message
            if chk_bug or chk_self:
                pass
            elif chk_bibil:#else:
                obj.ExpireSolution(True)
# ---------- end resetsol ----------

# ----
panel = Panel(resetsol)
panel_2 = Panel("""7.5:3.0
19.5:6.0""")
panel_3 = Panel("""7.5:9.0
13.5:15.0""")
multiplication = Multiplication(A=number_slider_2, B=Slider(3, range=0..10))
multiplication_2 = Multiplication(A=number_slider_2, B=Slider(2, range=0..10))
multiplication_3 = Multiplication(A=number_slider_2, B=Slider(3, range=0..10))
multiplication_4 = Multiplication(A=number_slider_2, B=Slider(2, range=0..10))

# ----
# SET/STEPBACK
# PARAMETER
python_4 = PythonScript(inc=number_slider_2, index2inc="1", template="7.5:1.5")  # -> parameter; inputs index2inc: Int32, template: list
# ---------- python_4: Python ----------
def generate_parameter(inc_,index_,template_):
    splt = ":" if ":" in template_[0] else ","
    t = []
    for i in xrange(len(template_)):
        exist_str = template_[i].split(splt)
        param2inc = float(exist_str[index_]) + float(inc_)
        exist_str[index_] = str(param2inc)
        t.append(splt.join(exist_str))
    return t

parameter = generate_parameter(inc,index2inc,template)
#print parameter
# ---------- end python_4 ----------

# ----
# SET/STEPBACK
# PARAMETER
python_5 = PythonScript(inc=multiplication_2, index2inc="1", template="13.5:3.0")  # -> parameter; inputs index2inc: Int32, template: list; same code as python_4

# ----
# SET/STEPBACK
# PARAMETER
python_6 = PythonScript(inc=multiplication, index2inc="1", template="19.5:4.5")  # -> parameter; inputs index2inc: Int32, template: list; same code as python_4

# ----
# FRONT
# SET/STEPBACK
# PARAMETER
python_7 = PythonScript(inc=number_slider_2, index2inc="1", template=panel_2)  # -> parameter; inputs index2inc: Int32, template: list; same code as python_4

# ----
# SIDE
# SET/STEPBACK
# PARAMETER
python_8 = PythonScript(inc=multiplication_4, index2inc="1", template=panel_3)  # -> parameter; inputs index2inc: Int32, template: list; same code as python_4

# ----
# REAR
# SET/STEPBACK
# PARAMETER
python_9 = PythonScript(inc=multiplication_3, index2inc="1", template="19.5:3.0")  # -> parameter; inputs index2inc: Int32, template: list; same code as python_4

# ----
# COLLAPSE THIS
# DEMAND
# PARAMETER
podium_ht = PythonScript(node_in=python.res_node, ht_threshold=number_slider_3, density_index=number_slider)  # -> hi, lo; inputs node_in: list, density_index: Int32
# ---------- podium_ht: Python ----------
import Grasshopper
import Grasshopper.Kernel as gh

ghenv.Component.Message = 'Bibil_2'


def set_density(parcel):
    lo,hi = [],[]
    for i in xrange(len(parcel)):
        pa = parcel[i]
        x_dist = pa.shape.x_dist
        y_dist = pa.shape.y_dist
        demand_ = pa.shape.ht
        
        # HIRISE
        if demand_ > MIN_HI_HT and x_dist > MIN_HI_DIST and y_dist > MIN_HI_DIST:
            hi.append(pa)
        # LOWRISE
        else:
            lo.append(pa)
    return hi,lo

MIN_HI_DIST = 20.0
MIN_HI_HT = ht_threshold
select_node = node_in[density_index]
hi,lo = set_density(select_node)
# ---------- end podium_ht ----------

# ----
# DEMAND
# PARAMETER
podium_ht_2 = PythonScript(node_in=python.com_node, ht_threshold=number_slider_3, density_index=number_slider)  # -> hi, lo; inputs node_in: list, density_index: Int32
# ---------- podium_ht_2: Python ----------
def set_density(parcel):
    lo,hi = [],[]
    for i in xrange(len(parcel)):
        p = parcel[i]
        x_dist = p.shape.x_dist
        y_dist = p.shape.y_dist
        demand_ = p.shape.ht
        # HIRISE
        if demand_ > MIN_HI_HT and x_dist > MIN_HI_DIST and y_dist > MIN_HI_DIST:
            hi.append(p)
        # LOWRISE
        else:
            lo.append(p)
    return hi,lo

if node_in and ht_threshold and density_index:
    MIN_HI_DIST = 20.0
    MIN_HI_HT = ht_threshold
    if len(node_in)>=density_index:
        select_node = node_in[density_index]
        hi,lo = set_density(select_node)
# ---------- end podium_ht_2 ----------

# ----
# PODIUM HT
# PARAMETER
data_3 = Data(number_slider_3)

# ----
# PODIUM HT
# PARAMETER
data_4 = Data(number_slider_3)

panel_4 = Panel(python_5)
panel_5 = Panel(python_6)
panel_6 = Panel(python_4)
g_3 = PythonScript(node=podium_ht_2.hi)  # -> geom; inputs node: list
# ---------- g_3: Python ----------
node = filter(lambda n: n!=None,node)
if node and node != []:
    geom = []
    for n in node:
        if n.shape.z_dist < 1.2:
            geom.append(n.shape.bottom_crv)
        else:
            geom.append(n.shape.geom)
    print geom
# ---------- end g_3 ----------
g_4 = PythonScript(node=podium_ht_2.lo)  # -> geom; inputs node: list; same code as g_3

# ---- group: DON'T PASS NODES
g_5 = PythonScript(node=podium_ht.hi)  # -> geom; inputs node: list; same code as g_3
g_6 = PythonScript(node=podium_ht.lo)  # -> geom; inputs node: list; same code as g_3

# ----
# AVENUES
number_slider_4 = Slider(12, range=0..100)
geo_4 = Geometry([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])

# ----
# STREETS
number_slider_5 = Slider(85, range=0..100)
geo_5 = Geometry(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)

panel_7 = Panel("-1")
number_slider_6 = Slider(0, range=0..100)
panel_8 = Panel("HiResTower")
number_slider_7 = Slider(0, range=0..100)
panel_9 = Panel(python_4)
panel_10 = Panel(python_4)
# TOWERS
toggle = BooleanToggle(True)
panel_11 = Panel("MidRes")
# PODIUM
toggle_2 = BooleanToggle(True)

# ---- group: EXTRACT_SLICE
miru_9 = PythonScript(Code=file_16, Run=toggle)

# ---- group: SETBACK
miru_10 = PythonScript(Code=file_10, Height_stepback=panel_9, Stepback_ref=geo_4, Stepback_tol=number_slider_4, Run=Toggle(True))

# ---- group: PACKING
separatedata_2 = Ladybug_SeparateData(Code=file_9, X_keep_omit="18.0,25.0", Y_keep_omit="40.0,25.0", Run=Toggle(True))

# ---- group: HEIGHT
miru_11 = PythonScript(Code=file_11, Height_ref=Slider(10, range=0..10), Run=Toggle(True))

# ---- group: SETBACK
miru_12 = PythonScript(Code=file_10, Height_stepback=panel_10, Stepback_ref=geo_5, Stepback_tol=number_slider_5, Run=Toggle(True))

# ---- group: PERIMETER
miru_13 = PythonScript(Code=file_8, Width=Slider(35, range=0..100), Court_ref="0", Run=Toggle(True))

# ---- group: HEIGHT
miru_14 = PythonScript(Code=file_11, Height=data_4, Height_ref="MidRes", Run=Toggle(True))

# ---- group: SETBACK
miru_15 = PythonScript(Code=file_10, Height_stepback="0.0:12.5", Run=Toggle(True))

# ---- group: PACKING
separatedata_3 = Ladybug_SeparateData(Code=file_9, X_keep_omit="17.5,25.0", Y_keep_omit="40.0,25.0", Run=Toggle(True))

# ---- group: TREE RULES
miru_16 = PythonScript(Code=file_13, Node=bibil_6.Node_out, Run=toggle_2)

# ---- group: SHAPENODE
bibil_9 = PythonScript(
    Code=file_6,
    Rule_in=flatten([miru_16, miru_13, miru_14, miru_12, miru_10]),
    Node_in=flatten([g_5, g_6]),
    Label_="MidRes",
    Run=Toggle(True))  # -> Node_out, Debug

# ----
geo_6 = Geometry(bibil_9.Debug)  # disabled
sunion = SolidUnion(Breps=geo_6)  # disabled
fmerge = MergeFaces(Brep=sunion)  # -> Breps, Before, After; disabled
geo_7 = Geometry(bibil_9.Debug)
g_7 = PythonScript(node=bibil_9.Node_out)  # -> geom; inputs node: list; same code as g_3
g_8 = PythonScript(node=bibil_9.Node_out)  # -> street; inputs node: list
# ---------- g_8: Python ----------
node = filter(lambda n: n!=None,node)
if node and node != []:
    street = []
    for n in node:
        loc = n.backtrack_tree(lambda n: n.grammar.type.has_key('street_tolerance_curve'),accumulate=True)
        street.extend(map(lambda n:n.grammar.type['street_tolerance_curve'],loc))
    
    street = reduce(lambda x,y:x+y,street)
    print street
# ---------- end g_8 ----------

# ---- group: SHAPENODE
bibil_10 = PythonScript(
    Code=file_6,
    Rule_in=flatten([miru_9, separatedata_2, miru_11]),
    Node_in=flatten(bibil_9.Node_out),
    Label_="HiResTower",
    Run=Toggle(True))  # -> Node_out, Debug

bibil_11 = PythonScript(Code=file_6, Rule_in=flatten([miru_15, separatedata_3]), Node_in=flatten(fmerge.Breps), Label_="T", Run=Toggle(False))  # -> Node_out, Debug

# ----
wires = BrepWireframe(Brep=g_5, Density=-1)
g_9 = PythonScript(node=bibil_10.Node_out)  # -> geom; inputs node: list
# ---------- g_9: Python ----------
node = filter(lambda n: n!=None,node)
if node and node != []:
    geom = []
    for n in node:
        geom.append(n.shape.geom)
# ---------- end g_9 ----------
geo_8 = Geometry(bibil_10.Debug)
g_10 = PythonScript(node=bibil_11.Node_out)  # -> geom; inputs node: list; same code as g_9
preview = CustomPreview(
    Geometry=g_9,
    Shader={ambient=RGB(0, 0, 0), diffuse=RGB(255, 105, 180), emission=RGB(76, 32, 54), shine=0.5, specular=RGB(255, 255, 255), transparency=0})
previewlw = CustomPreviewLineweights(Geometry=wires, Shader=ColourSwatch(SwatchColor=RGB(255, 0, 255)), Thickness=Slider(2, range=0..10))
Z = UnitZ(Factor=Slider(-22.5, range=-25..12))
python_10 = PythonScript()  # -> a, b
# ---------- python_10: Python ----------
import rhinoscriptsyntax as rs
import scriptcontext as sc

Shape = sc.sticky['Shape']

cpt = rs.CurveAreaCentroid(x)[0]

S = Shape()

if S.is_near_zero(cpt[2]):
    a = x
else:
    b = x
# ---------- end python_10 ----------
move = Move(Geometry=python_10.b, Motion=Z)  # -> Geometry, Transform
geo_9 = Geometry(bibil_11.Debug)
dash = DashPattern(Curve=[move.Geometry, python_10.a], Pattern=Slider(2, range=0..10))  # -> Dashes, Gaps
previewlw_2 = CustomPreviewLineweights(Geometry=dash.Dashes, Shader=ColourSwatch(SwatchColor=RGB(128, 128, 128)), Thickness=Slider(2, range=0..10))

# ---- group: filternull
python_11 = PythonScript(x=[g_7, g_9])  # -> a; inputs x: list
# ---------- python_11: Python ----------
a = filter(lambda n:n!=None,x)
# ---------- end python_11 ----------

# ----
geo_10 = Geometry([python_11, g_10])
