# Grasshopper definition bibil_acadia_23_minimal.gh (Grasshopper 0.9.76)
# plug-ins: Python Interpreter, ArchsimGH, HDTReference

list = ValueList({"dir", "file"}, selected="dir")

# ---- group: find directory
bibil = PythonScript(
    dir=["C:\\Users\\vasanthakumars\\Documents\\GitHub\\bibil\\src", "C:\\saeran\\master\\git\\bibil\\src"],
    type=list,
    run=Toggle(True))  # -> dir; inputs dir: list
# ---------- bibil: Python ----------
import os
import sys

ghenv.Component.Params.Output[0].Name = "null"
ghenv.Component.Params.Output[0].NickName = "null"

#sys.path.append("C:\Program Files\Rhinoceros 5.0 (64-bit)\System")

if run:
    confirm_dir = None
    for d in dir:
        try:
            if type == "file":
                file_ = open(d)
                file_.close()
            else:
                print os.listdir(d)
            confirm_dir = d
            break
        except Exception as e:
            #print str(e)
            continue
    if confirm_dir != None:
        ghenv.Component.Params.Output[0].Name = type
        ghenv.Component.Params.Output[0].NickName = type
        dir = confirm_dir
        file = confirm_dir
null = None
# ---------- end bibil ----------

# ---- group: node_bucket
python_script = PythonScript(i=bibil)  # -> o
# ---------- python_script: Python ----------
import os

if i:
    o = os.path.join(str(i),"miru\\miru_shape_bucket.py")
# ---------- end python_script ----------
file = ReadFile(File=python_script, PerLineParse=False)

# ---- group: stepback_manual
# STREETS
# AVENUES
python_script_2 = PythonScript(i=bibil)  # -> o
# ---------- python_script_2: Python ----------
import os

if i:
    o = os.path.join(str(i),"miru\\miru_stepback_manual.py")
# ---------- end python_script_2 ----------
file_2 = ReadFile(File=python_script_2, PerLineParse=False)

# ---- group: tree
python_script_3 = PythonScript(i=bibil)  # -> o
# ---------- python_script_3: Python ----------
import os

if i:
    o = os.path.join(str(i),"bibil\\bibil_tree.py")
# ---------- end python_script_3 ----------
file_3 = ReadFile(File=python_script_3, PerLineParse=False)
bibil_2 = PythonScript(Code=file_3)

# ---- group: grammar
python_script_4 = PythonScript(i=bibil)  # -> o
# ---------- python_script_4: Python ----------
import os

if i:
    o = os.path.join(str(i),"bibil\\bibil_grammar.py")
# ---------- end python_script_4 ----------
file_4 = ReadFile(File=python_script_4, PerLineParse=False)
bibil_3 = PythonScript(Code=file_4)

# ---- group: shape
python_script_5 = PythonScript(i=bibil)  # -> o
# ---------- python_script_5: Python ----------
import os

if i:
    o = os.path.join(str(i),"bibil\\bibil_shape.py")
#o = os.path.join(str(i),"research\\bibil_shape_shape_3d_2d.py")
# ---------- end python_script_5 ----------
file_5 = ReadFile(File=python_script_5, PerLineParse=False)
bibil_4 = PythonScript(Code=file_5)

# ---- group: bula
python_script_6 = PythonScript(i=bibil)  # -> o
# ---------- python_script_6: Python ----------
import os

if i:
    o = os.path.join(str(i),"bula\\bula_minimal.py")
# ---------- end python_script_6 ----------
file_6 = ReadFile(File=python_script_6, PerLineParse=False)
bibil_5 = PythonScript(Code=file_6)

# ---- group: UI
python_script_7 = PythonScript(i=bibil)  # -> o
# ---------- python_script_7: Python ----------
import os

if i:
    o = os.path.join(str(i),"bibil\\bibil_UI.py")
# ---------- end python_script_7 ----------
file_7 = ReadFile(File=python_script_7, PerLineParse=False)

# ---- group: grammar_divide
python_script_8 = PythonScript(i=bibil)  # -> o
# ---------- python_script_8: Python ----------
import os

if i:
    o = os.path.join(str(i),"miru\\miru_divide.py")
# ---------- end python_script_8 ----------
file_8 = ReadFile(File=python_script_8, PerLineParse=False)

# ---- group: grammar_courtyard
python_script_9 = PythonScript(i=bibil)  # -> o
# ---------- python_script_9: Python ----------
import os

if i:
    o = os.path.join(str(i),"miru\\miru_court.py")
# ---------- end python_script_9 ----------
file_9 = ReadFile(File=python_script_9, PerLineParse=False)

# ---- group: grammar_tower
python_script_10 = PythonScript(i=bibil)  # -> o
# ---------- python_script_10: Python ----------
import os

if i:
    o = os.path.join(str(i),"miru\\miru_packing.py")
# ---------- end python_script_10 ----------
file_10 = ReadFile(File=python_script_10, PerLineParse=False)

# ---- group: stepback
python_script_11 = PythonScript(i=bibil)  # -> o
# ---------- python_script_11: Python ----------
import os

if i:
    o = os.path.join(str(i),"miru\\miru_stepback.py")
# ---------- end python_script_11 ----------
file_11 = ReadFile(File=python_script_11, PerLineParse=False)

# ---- group: grammar_height
python_script_12 = PythonScript(i=bibil)  # -> o
# ---------- python_script_12: Python ----------
import os

if i:
    o = os.path.join(str(i),"miru\\miru_height.py")
# ---------- end python_script_12 ----------
file_12 = ReadFile(File=python_script_12, PerLineParse=False)

# ---- group: grammar_analysis_pts
python_script_13 = PythonScript(i=bibil)  # -> o
# ---------- python_script_13: Python ----------
import os

if i:
    o = os.path.join(str(i),"miru\\miru_analysis.py")
# ---------- end python_script_13 ----------
file_13 = ReadFile(File=python_script_13, PerLineParse=False)

# ---- group: meta_tree
python_script_14 = PythonScript(i=bibil)  # -> o
# ---------- python_script_14: Python ----------
import os

if i:
    o = os.path.join(str(i),"miru\\miru_meta_tree.py")
# ---------- end python_script_14 ----------
file_14 = ReadFile(File=python_script_14, PerLineParse=False)

# ---- group: land_use
python_script_15 = PythonScript(i=bibil)  # -> o
# ---------- python_script_15: Python ----------
import os

if i:
    o = os.path.join(str(i),"miru\\miru_landuse.py")
# ---------- end python_script_15 ----------
file_15 = ReadFile(File=python_script_15, PerLineParse=False)

# ---- group: shape2height
python_script_16 = PythonScript(i=bibil)  # -> o
# ---------- python_script_16: Python ----------
import os

if i:
    o = os.path.join(str(i),"miru\\miru_shape2height.py")
# ---------- end python_script_16 ----------
file_16 = ReadFile(File=python_script_16, PerLineParse=False)

# ---- group: extract_slice
python_script_17 = PythonScript(i=bibil)  # -> o
# ---------- python_script_17: Python ----------
import os

if i:
    o = os.path.join(str(i),"miru\\miru_extract_slice.py")
# ---------- end python_script_17 ----------
file_17 = ReadFile(File=python_script_17, PerLineParse=False)

# ----
list_2 = ValueList({"divide by depth": "subdivide_depth", "divide by same depth": "subdivide_depth_same", "divide by dim": "subdivide_dim"}, selected="divide by same depth")
list_3 = ValueList({"YZ": "NS", "XZ": "EW", "XY": "Z"}, selected="XZ")

# ---- group: SETBACK
miru = PythonScript(Code=file_11, Height_stepback="22.5:6.0", Run=Toggle(False))

# ---- group: PACKING
separatedata = Ladybug_SeparateData(Code=file_10, X_keep_omit="27.0,25.0", Y_keep_omit="27.0,25.0", Seperation_ref="-1", Run=Toggle(False))

# ---- group: ENERGY_MODEL_BUCKET
miru_2 = PythonScript(Code=file, Run=Toggle(True))

# ---- group: EXTRACT_SLICE
miru_3 = PythonScript(Code=file_17, Run=Toggle(False))

# ---- group: DIVIDE
miru_4 = PythonScript(
    Code=file_8,
    Divide_num=Slider(2, range=0..10),
    Divide_cut=Slider(0, range=0..100),
    Divide_type=list_2,
    Divide_ratio=Slider(0.5, range=0..1),
    Axis=list_3,
    Run=Toggle(False))

# ---- group: PERIMETER
miru_5 = PythonScript(Code=file_9, Width=Slider(20, range=0..100), Cut_width=Slider(0, range=0..100), Court_ref="0", Run=Toggle(False))

# ---- group: HEIGHT
miru_6 = PythonScript(Code=file_12, Height=Slider(16.5, range=0..100), Run=Toggle(True))

# ---- group: TREE RULES
miru_7 = PythonScript(Code=file_14, Run=Toggle(False))

# ---- group: SHAPE2HEIGHT
miru_8 = PythonScript(Code=file_16, Run=Toggle(False))

# ---- group: fix geom
geo = Geometry([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])

# ----
geo_2 = Geometry([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])
geo_3 = Geometry([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])
geo_4 = Geometry([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])
geo_5 = Geometry([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])
geo_6 = Geometry([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])
geo_7 = Geometry([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])
bibil_6 = PythonScript(Code=file_7, Node_in=flatten(geo_4), Label_="density_04", Run=Toggle(True))  # -> Node_out, Debug
bibil_7 = PythonScript(Code=file_7, Node_in=flatten(geo_2), Label_="density_03", Run=Toggle(True))  # -> Node_out, Debug
bibil_8 = PythonScript(Code=file_7, Node_in=flatten(geo_5), Label_="density_02", Run=Toggle(True))  # -> Node_out, Debug
bibil_9 = PythonScript(Code=file_7, Node_in=flatten(geo_6), Label_="density_01", Run=Toggle(True))  # -> Node_out, Debug
bibil_10 = PythonScript(Code=file_7, Node_in=flatten(geo_3), Label_="density_00", Run=Toggle(True))  # -> Node_out, Debug

# ---- group: SQUARE DIAGONAL
geo_8 = Geometry(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)

# ---- group: DRAGONFLY
geo_9 = Geometry([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])

# ---- group: STEPBACK_PARAMETER
number_slider = Slider(0, range=0..4)
panel = Panel("[0.0,1.5,3.0,4.5,6.0]")

# ---- group: PODIUM_PARAMETER
panel_2 = Panel("[7.5,10.5,13.5,16.5,19.5,22.5,25.5,28.5,31.5]")
number_slider_2 = Slider(0, range=0..8)

# ---- group: SETBACK_PARAMETER
panel_3 = Panel("[0.0,1.5,3.0,4.5,6.0]")
number_slider_3 = Slider(0, range=0..4)

# ---- group: ARCHETYPE_PARAMETER
panel_4 = Panel("['tower_in_park','tower_on_podium','slab_in_park','slab_on_podium']")
number_slider_4 = Slider(3, range=0..3)

# ---- group: DENSITY_PARAMETER
panel_5 = Panel("[0,1,2,3,4]")
number_slider_5 = Slider(0, range=0..4)

# ----
data = Data([bibil_6.Node_out, bibil_7.Node_out, bibil_8.Node_out, bibil_9.Node_out, bibil_10.Node_out])
podium_ht = PythonScript(
    density_set=panel_5,
    density_par=number_slider_5,
    arctype_set=panel_4,
    arctype_par=number_slider_4,
    podium_set=panel_2,
    podium_par=number_slider_2,
    setback_set=panel_3,
    setback_par=number_slider_3,
    stepback_set=panel,
    stepback_par=number_slider,
    node_in=data,
    run=Toggle(True))  # -> node_out, arctype_str, podium_ht, setback_dim, stepback_dim; inputs density_par: Int32, arctype_par: Int32, podium_par: Int32, setback_par: Int32, stepback_par: Int32, node_in: list
# ---------- podium_ht: Python ----------
import Grasshopper
import Grasshopper.Kernel as gh
import scriptcontext as sc

ghenv.Component.Message = 'Bibil_2'

Bula = sc.sticky['Bula']
Grammar = sc.sticky['Grammar']

B = Bula()
G = Grammar()

if run and node_in:
    
    # Bucket according to density label
    bucket_dict = {"apply2list":True, "keys2bucket":["label"],\
                    "fx2bucket":"lambda n:n.grammar.type['label']"}
                    
    bucketed_lst = G.bucket_shape(node_in,bucket_dict)
    nestedbylabel = bucketed_lst[0]
    nestedbylabel.sort(key=lambda tple:tple[0])
    node_in = map(lambda l:l[1],nestedbylabel)
    
    #Density Parameter
    density_set = eval(density_set)
    density_index = density_set[density_par] 
    node_out = node_in[density_index]
    
    #Arctype Parameters
    arctype_set = eval(arctype_set)
    arctype_str = arctype_set[arctype_par]
    
    #Podium Parameters
    podium_set = eval(podium_set)
    podium_ht = podium_set[podium_par]
    
    #Stepback Parameters
    stepback_set = eval(stepback_set)
    stepback_dim = stepback_set[stepback_par]
    
    #Setback Parameters
    setback_set = eval(setback_set)
    setback_dim = setback_set[setback_par]
# ---------- end podium_ht ----------
python = PythonScript()  # -> res_node, com_node; inputs init_zones: list, init_nodes: list; disabled
# ---------- python: Python ----------
import random
import scriptcontext as sc
import Rhino as rc
import rhinoscriptsyntax as rs

import Grasshopper
import Grasshopper.Kernel as gh
import scriptcontext as sc
ghenv.Component.Message = 'Bibil_1'

Bula = sc.sticky['Bula']
Grammar = sc.sticky['Grammar']
sc.sticky['GLOBAL_COLLISION_LIST'] = []

def normalize_all_heights(raw_nodes):
    D={}
    max = raw_nodes[0].shape.ht
    min = raw_nodes[0].shape.ht
    htlst = []
    for i in xrange(len(raw_nodes)):
        ht = raw_nodes[i].shape.ht
        if ht>max:
            max = ht
        if ht<min:
            min = ht
        htlst.append(ht)
    #max and min heights
    normlst = B.normalize_list(htlst,91.5,10.5)
    map(lambda nh: nh[0].shape.op_extrude(nh[1]),zip(raw_nodes,normlst))
    return raw_nodes
def set_parcel_by_zone(parcel_,zone_):
    L = []
    cpt = parcel_.shape.cpt
    for j in xrange(len(zone_)):
        zonecrv = zone_[j]
        #debug.append(zonecrv)
        IsIn = rs.PointInPlanarClosedCurve(cpt,zonecrv)
        if IsIn>0.5:
            IsDefined = True
            #debug.append(parcel)
            L.append(parcel_)
            break
    return L

if run:
    B = Bula()
    G = Grammar()
    # Normalize all heights
    norm_nodes = normalize_all_heights(init_nodes)
    
    # Sort the parcels by res/com boundaries
    # There needs to be a better spatial partiioning algorithm to do this part
    # Time complexity = O(2m) + O(4n)
    
    res_zones = []
    res_parcels,com_parcels = [],[]
    
    for i in xrange(len(init_zones)):
        zone = init_zones[i]
        if 'res' in zone.grammar.type['label'].lower():
            res_zones.append(zone.shape.bottom_crv)
            
    for i in xrange(len(norm_nodes)):
        norm = norm_nodes[i]
        IsInRes = set_parcel_by_zone(norm,res_zones)
        if IsInRes:
            res_parcels.append(norm)
        else:
            com_parcels.append(norm)
    
    zone_lst = [res_parcels, com_parcels]
    
    # Bucket according to density label
    bucket_dict = {"apply2list":True, "keys2bucket":["label"],\
                    "fx2bucket":"lambda n:n.grammar.type['label']"}
    for i in xrange(len(zone_lst)):
        nodesbytype = zone_lst[i]
        bucketed_lst = G.bucket_shape(nodesbytype,bucket_dict)
        nestedbylabel = bucketed_lst[0]
        nestedbylabel.sort(key=lambda tple:tple[0])
        zone_lst[i] = map(lambda l:l[1],nestedbylabel)
    
    res_node = zone_lst[0]
    com_node = zone_lst[1]
# ---------- end python ----------
data_2 = Data(podium_ht.podium_ht)
data_3 = Data(podium_ht.setback_dim)
data_4 = Data(podium_ht.stepback_dim)
panel_6 = Panel(podium_ht.podium_ht)
panel_7 = Panel(podium_ht.setback_dim)
panel_8 = Panel(podium_ht.stepback_dim)
g = PythonScript(node=podium_ht.node_out)  # -> geom; inputs node: list
# ---------- g: Python ----------
node = filter(lambda n: n!=None,node)
if node and node != []:
    geom = []
    for n in node:
        if n.shape.z_dist < 1.2:
            geom.append(n.shape.bottom_crv)
        else:
            geom.append(n.shape.geom)
    print geom
# ---------- end g ----------
geo_10 = Geometry(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)
geo_11 = Geometry(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)
python_2 = PythonScript(
    arctype_str=podium_ht.arctype_str,
    slab_short="19.0,5.0",
    slab_long="38,5.0",
    tower_short="26.0,15.0",
    tower_long="26.0,15.0",
    run=Toggle(True))  # -> park, podium, dim_short, dim_long; inputs slab_short: list, tower_short: list
# ---------- python_2: Python ----------
park,podium = False,False
dim_short,dim_long = slab_short,slab_long

if arctype_str and run:
    arc_lst = arctype_str.split('_')
    #tower in park
    if 'tower' in arc_lst and 'park' in arc_lst:
        park = True
        dim_short = tower_short
        dim_long = tower_long
    #tower in podium
    elif 'tower' in arc_lst and 'podium' in arc_lst:
        podium = True
        dim_short = tower_short
        dim_long = tower_long
    #slab in park
    elif 'slab' in arc_lst and 'park' in arc_lst:
        park = True
        dim_short = slab_short
        dim_long = slab_long
    #slab in podium
    else:#if 'slab' in arc_lst and 'podium' in arc_lst:
        podium = True
        dim_short = slab_short
        dim_long = slab_long
    
    print arctype_str
    print park
    print podium
    print dim_short
    print dim_long
# ---------- end python_2 ----------

# ---- group: grnd@0
python_3 = PythonScript(crv_in=[geo_10, geo_11])  # -> crv_out
# ---------- python_3: Python ----------
import rhinoscriptsyntax as rs
import Rhino as rc

curve = rs.coercecurve(crv_in)
rc_, polyline = curve.TryGetPolyline()
if rc_: 
    points = map(lambda pt:pt,polyline)
    for pt in points:
        pt.Z = 0.0
    curve = rc.Geometry.Curve.CreateControlPointCurve(points,1)
crv_out = curve
# ---------- end python_3 ----------

# ----
number_slider_6 = Slider(15, range=0..100)
data_5 = Data(python_2.dim_short)
data_6 = Data(python_2.dim_long)
bool = Boolean(python_2.park)
bool_2 = Boolean(python_2.podium)

# ---- group: ROOT
# ROOT
bibil_11 = PythonScript(Code=file_7, Node_in=flatten(python_3), Label_="Root", Run=Toggle(True))  # -> Node_out, Debug

# ----
geo_12 = Geometry(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)
geo_13 = Geometry([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])
# STREETS
toggle = BooleanToggle(True)
g_2 = PythonScript(node=bibil_11.Node_out)  # -> geom; inputs node: list
# ---------- g_2: Python ----------
node = filter(lambda n: n!=None,node)
if node and node != []:
    geom = []
    for n in node:
        if n.shape.UIgeom != None:
            geom.append(n.shape.UIgeom)
        else:
            geom.append(n.shape.geom)
# ---------- end g_2 ----------

# ---- group: TREE RULES
miru_9 = PythonScript(Code=file_14, Node=bibil_11.Node_out, Run=toggle)

# ----
# AVENUES
number_slider_7 = Slider(5, range=0..10)
swatch = ColourSwatch(SwatchColor=RGB(255, 255, 255))
previewlw = CustomPreviewLineweights(Geometry=geo_12, Shader=swatch, Thickness=number_slider_7)
previewlw_2 = CustomPreviewLineweights(Geometry=geo_13, Shader=swatch, Thickness=Slider(2, range=0..10))

# ---- group: SHAPENODE
bibil_12 = PythonScript(Code=file_7, Rule_in=flatten(miru_9), Node_in=flatten(g), Label_="PerimeterBlock", Run=Toggle(True))  # -> Node_out, Debug

# ----
# BLOCK
number_slider_8 = Slider(30, range=0..100)
g_3 = PythonScript(node=bibil_12.Node_out)  # -> geom; inputs node: list; same code as g_2

# ---- group: SETBACK
miru_10 = PythonScript(
    Code=file_2,
    Height_dim=Slider(4.5, range=0..10),
    Stepback_dim=Slider(5, range=0..10),
    Stepback_ref=geo_12,
    Stepback_tol=Slider(11, range=0..100),
    Run=Toggle(True))

miru_11 = PythonScript(
    Code=file_2,
    Height_dim=Slider(10, range=0..10),
    Stepback_dim=Slider(5, range=0..10),
    Stepback_ref=geo_13,
    Stepback_tol=number_slider_6,
    Run=Toggle(True))

miru_12 = PythonScript(Code=file_2, Height_dim=Slider(0, range=0..100), Stepback_dim=Slider(2.5, range=0..10), Run=Toggle(True))

# ---- group: HEIGHT
miru_13 = PythonScript(Code=file_12, Height=number_slider_8, Run=Toggle(True))

# ---- group: SHAPENODE
bibil_13 = PythonScript(
    Code=file_7,
    Rule_in=flatten([miru_13, miru_10, miru_11, miru_12]),
    Node_in=flatten(bibil_12.Node_out),
    Label_="MidRes",
    Run=Toggle(True))  # -> Node_out, Debug

# ----
# COURT
number_slider_9 = Slider(36.5, range=0..100)
toggle_2 = BooleanToggle(True)
g_4 = PythonScript(node=bibil_13.Node_out)  # -> geom; inputs node: list; same code as g

# ---- group: SETBACK
miru_14 = PythonScript(
    Code=file_2,
    Height_dim=Slider(21, range=0..100),
    Stepback_dim=Slider(4, range=0..10),
    Stepback_ref=[geo_13, geo_12],
    Stepback_tol=number_slider_6,
    From_rear=toggle_2,
    Run=toggle_2)

# ---- group: PERIMETER
miru_15 = PythonScript(Code=file_9, Width=number_slider_9, Court_ref="0", Run=Toggle(True))

# ---- group: SHAPENODE
bibil_14 = PythonScript(Code=file_7, Rule_in=flatten([miru_15, miru_14]), Node_in=flatten(bibil_13.Node_out), Run=Toggle(True))  # -> Node_out, Debug

# ----
python_4 = PythonScript()  # -> a; inputs x: list
# ---------- python_4: Python ----------
import rhinoscriptsyntax as rs
import scriptcontext as sc

#Shape = sc.sticky['Shape']
#S = Shape()

L = []
x = filter(lambda n: n!=None,x)
if x:
    for i in x:
        cpt = rs.CurveAreaCentroid(i)[0]
        if cpt[2] > 0.0:
            obj = rs.MoveObject(i,[0,0,cpt[2]*-1])
            L.append(obj)
        else:
            L.append(i)
a = L
# ---------- end python_4 ----------
g_5 = PythonScript()  # -> street; inputs node: list
# ---------- g_5: Python ----------
node = filter(lambda n: n!=None,node)
if node and node != []:
    street = []
    for n in node:
        loc = n.backtrack_tree(lambda n: n.grammar.type.has_key('street_tolerance_curve'),accumulate=True)
        street.extend(map(lambda n:n.grammar.type['street_tolerance_curve'],loc))
    if street:
        street = reduce(lambda x,y:x+y,street)
    print street
# ---------- end g_5 ----------
geo_14 = Geometry(bibil_14.Debug)
python_5 = PythonScript(node=bibil_14.Node_out, bool=bool_2)  # -> node_out
# ---------- python_5: Python ----------
if bool:
    node_out = node
else:
    node_out = None
# ---------- end python_5 ----------
dash = DashPattern(Curve=python_4, Pattern=Slider(1, range=0..10))  # -> Dashes, Gaps
dash_2 = DashPattern(Curve=g_5, Pattern=Slider(2, range=0..10))  # -> Dashes, Gaps
g_6 = PythonScript(node=python_5)  # -> geom; inputs node: list
# ---------- g_6: Python ----------
node = filter(lambda n: n!=None,node)
if node and node != []:
    geom = []
    for n in node:
        geom.append(n.shape.geom)
    print geom
# ---------- end g_6 ----------
preview = CustomPreview(Geometry=dash_2.Dashes, Shader=ColourSwatch(SwatchColor=RGB(255, 255, 255)))
previewlw_3 = CustomPreviewLineweights(Geometry=dash.Dashes, Shader=ColourSwatch(SwatchColor=RGB(0, 255, 255)), Thickness=Slider(1, range=0..10))
# IN_PARK
# TOWERS
number_slider_10 = Slider(0, range=0..100)
# W_PODIUM
# TOWERS
toggle_3 = BooleanToggle(True)

# ---- group: PACKING
separatedata_2 = Ladybug_SeparateData(Code=file_10, Short_keep_omit=data_5, Long_keep_omit=data_6, Run=Toggle(True))

separatedata_3 = Ladybug_SeparateData(Code=file_10, Short_keep_omit=data_5, Long_keep_omit=data_6, Run=Toggle(True))

# ---- group: EXTRACT_SLICE
miru_16 = PythonScript(Code=file_17, Slice_height=number_slider_10, Run=Toggle(True))

miru_17 = PythonScript(Code=file_17, Run=toggle_3)

# ---- group: HEIGHT
miru_18 = PythonScript(Code=file_12, Height_ref="PerimeterBlock", Run=Toggle(True))

miru_19 = PythonScript(Code=file_12, Height_ref="PerimeterBlock", Run=Toggle(True))

# ---- group: SHAPENODE
bibil_15 = PythonScript(
    Code=file_7,
    Rule_in=flatten([miru_16, separatedata_2, miru_18]),
    Node_in=flatten(bibil_14.Node_out),
    Label_="HiResTower2",
    Run=bool)  # -> Node_out, Debug

bibil_16 = PythonScript(
    Code=file_7,
    Rule_in=flatten([miru_17, separatedata_3, miru_19]),
    Node_in=flatten(bibil_14.Node_out),
    Label_="HiResTower",
    Run=bool_2)  # -> Node_out, Debug

# ----
g_7 = PythonScript(node=bibil_15.Node_out)  # -> geom; inputs node: list
# ---------- g_7: Python ----------
node = filter(lambda n: n!=None,node)
if node and node != []:
    geom = []
    for n in node:
        geom.append(n.shape.geom)
# ---------- end g_7 ----------
g_8 = PythonScript(node=bibil_16.Node_out)  # -> geom; inputs node: list; same code as g_7
data_7 = Data([g_6, g_8])

# ---- group: filternull
python_6 = PythonScript(x=[data_7, g_7])  # -> a; inputs x: list
# ---------- python_6: Python ----------
a = filter(lambda n:n!=None,x)
# ---------- end python_6 ----------

# ----
ladybug = Ladybug_Ladybug()  # -> Vviiiiiiiiiizzz; disabled; plug-in component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
honeybee = Honeybee_Honeybee()  # -> Vviiiiiiiiiizzz; disabled; plug-in component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
dragonfly = Dragonfly_Dragonfly()  # -> Vviiiiiiiiiizzz; disabled; plug-in component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

# ----
# Import Climate Data
panel_9 = Panel("https://www.energyplus.net/weather-download/southwest_pacific_wmo_region_5/SGP//SGP_Singapore.486980_IWEC/all")  # disabled
epw_stat = Ladybug_OpenEPWAndSTATWeatherFiles(weatherFileURL=panel_9)  # -> epwFile, statFile; disabled; plug-in component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
importstat = Ladybug_ImportStat(statFile=epw_stat.statFile)  # -> readMe, ashraeClimateZone, koppenClimateZone, port, heatingDesignTemp, coolingDesignTemp, port_2, extremeHotWeek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; disabled; plug-in component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

panel_10 = Panel("3")  # disabled
geo_15 = Geometry([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])  # disabled
panel_11 = Panel("http://apps1.eere.energy.gov/buildings/energyplus/weatherdata/6_europe_wmo_region_6/FRA_Paris.Orly.071490_IWEC.zip")  # disabled
floor_cutter = FloorCutter(BuildingVolume=geo_15, FloorHeights=panel_10)  # disabled
toggle_4 = BooleanToggle(True)  # disabled
ground_zone = Brep([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])  # disabled
toggle_5 = BooleanToggle(True)  # disabled
toggle_6 = BooleanToggle(True)  # disabled
epw_stat_2 = Ladybug_OpenEPWAndSTATWeatherFiles(weatherFileURL=panel_11)  # -> epwFile, statFile; disabled; plug-in component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
mass2zone = Honeybee_Masses2Zones(zoneMasses=flatten(floor_cutter), isConditioned=toggle_6, maxRoofAngle=30, createHBZones=toggle_5)  # -> readMe, HBZones; disabled; plug-in component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
mass2zone_2 = Honeybee_Masses2Zones(zoneMasses=flatten(ground_zone), isConditioned=True, maxRoofAngle=30, createHBZones=toggle_4)  # -> readMe, HBZones; disabled; plug-in component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
toggle_7 = BooleanToggle(True)  # disabled
toggle_8 = BooleanToggle(False)  # disabled
soil_type = Panel("4")  # disabled
panel_12 = Panel(""".4
0
.4
0""")  # disabled
createepground = Honeybee_CreateEPGround(HBZones=mass2zone_2.HBZones, soilTypeOrMat=soil_type)  # -> HBGrndZones; disabled; plug-in component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
glazingcreator = Honeybee_GlazingBasedOnRatio(HBObjects=mass2zone.HBZones, glzRatio=panel_12, breakUpWindow=toggle_8, runIt=toggle_7)  # -> readMe, HBObjWGLZ; disabled; plug-in component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
importstat_2 = Ladybug_ImportStat(statFile=epw_stat_2.statFile)  # -> readMe, ashraeClimateZone, koppenClimateZone, port, heatingDesignTemp, coolingDesignTemp, port_2, extremeHotWeek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; disabled; plug-in component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

# ----
# Define Residential
# + Commercial Typologies
panel_13 = Panel("3")  # disabled
panel_14 = Panel("0.6")  # disabled
commercialtypology = Dragonfly_DefaultCommericalTypology(flr2FlrHeight=panel_13, window2Wall=panel_14, climateZone=importstat.ashraeClimateZone)  # -> buildingTypology; disabled; plug-in component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

toggle_9 = BooleanToggle(True)  # disabled
buildings = Brep(python_6)  # disabled
pavement = Brep(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)  # disabled
solveadjc = Honeybee_SolveAdjacencies(HBZones=flatten([createepground, glazingcreator.HBObjWGLZ]), removeCurrentAdjc=False, findAdjc=toggle_9)  # -> readMe, HBZonesWADJ; disabled; plug-in component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
panel_15 = Panel("""OutputControl:Table:Style,Comma;
Output:Variable,*,Surface Outside Face Temperature, hourly;""")  # disabled
hb_epcontextsrf = HoneybeeEPContextSurfaces()  # -> HBContext; inputs shdSurfaces: list of Brep, justBoundingBox: Boolean; disabled
# ---------- hb_epcontextsrf: Python ----------
"""
prepare shading/context geometries

    Args:
        northVectorOrRotation: A vector that shows North or a number that shows
                               the rotation of the North from the Y axis
        bldgMasses: List of closed Breps as thermal zones.
    Returns:
        report: ...
        thermalZones: Thermal zone's geometries for visualiza
"""

ghenv.Component.Name = 'Honeybee EP context Surfaces'
ghenv.Component.NickName = 'HB_EPContextSrf'
ghenv.Component.Message = 'VER 0.0.61\nFEB_05_2017'
ghenv.Component.IconDisplayMode = ghenv.Component.IconDisplayMode.application
ghenv.Component.Category = "Honeybee"
ghenv.Component.SubCategory = "10 | Energy | Energy"
#compatibleHBVersion = VER 0.0.57\nNOV_04_2016
#compatibleLBVersion = VER 0.0.59\nFEB_01_2015
ghenv.Component.AdditionalHelpFromDocStrings = "2"

import rhinoscriptsyntax as rs
import Rhino as rc
import scriptcontext as sc
import os
import System
import Grasshopper.Kernel as gh
import uuid

tolerance = sc.doc.ModelAbsoluteTolerance
import math


def main(shdSurfaces, EPTransSchedule, meshingSettings, justBoundingBox):
    
    # import the classes
    if sc.sticky.has_key('honeybee_release'):

        try:
            if not sc.sticky['honeybee_release'].isCompatible(ghenv.Component): return -1
            if sc.sticky['honeybee_release'].isInputMissing(ghenv.Component): return -1
        except:
            warning = "You need a newer version of Honeybee to use this compoent." + \
            " Use updateHoneybee component to update userObjects.\n" + \
            "If you have already updated userObjects drag Honeybee_Honeybee component " + \
            "into canvas and try again."
            w = gh.GH_RuntimeMessageLevel.Warning
            ghenv.Component.AddRuntimeMessage(w, warning)
            return -1
        
        # don't customize this part
        hb_EPSrf = sc.sticky["honeybee_EPSurface"]
        hb_EPSHDSurface = sc.sticky["honeybee_EPShdSurface"]
        hb_RADMaterialAUX = sc.sticky["honeybee_RADMaterialAUX"]
        hb_EPObjectsAux = sc.sticky["honeybee_EPObjectsAUX"]()
        HBScheduleList = sc.sticky["honeybee_ScheduleLib"].keys()

        ########################################################################
        #----------------------------------------------------------------------#
        shdBreps = []
        # create bounding box of shading geometries
        if justBoundingBox:
            for brep in shdSurfaces:
                if brep.Faces.Count>1 or not brep.Faces[0].IsPlanar(sc.doc.ModelAbsoluteTolerance):
                    shdBreps.append(brep.GetBoundingBox(True).ToBrep())
                else:
                    shdBreps.append(brep)
        else:
            shdBreps = shdSurfaces
        
        shadingClasses = []
        shadingMeshPreview = []
        
        if meshingSettings == None:
            mp = rc.Geometry.MeshingParameters.Minimal
            mp.SimplePlanes = True
        else:
            mp = meshingSettings
        
        def getRadMaterialName(radMaterial):
            nameStr = radMaterial.split(" ")[2]
            name =  nameStr.split("\n")[0]
            return name
        
        for brepCount, brep in enumerate(shdBreps):
            if brep != None:
                isPlanar = True
                # check planarity
                for face in brep.Faces:
                    if not face.IsPlanar(tolerance):
                        isPlanar = False
                        break
                
                shadingBreps = []
                if not isPlanar:
                    meshArray = rc.Geometry.Mesh.CreateFromBrep(brep, mp)
                    for mesh in meshArray:
                        for meshFace in range(mesh.Faces.Count):
                            vertices = list(mesh.Faces.GetFaceVertices(meshFace))[1:]
                            vertices = vertices + [sc.doc.ModelAbsoluteTolerance]
                            # create the brep from mesh
                            shdBrep = rc.Geometry.Brep.CreateFromCornerPoints(*vertices)
                            shadingBreps.append(shdBrep)
                else:
                    for face in brep.Faces:
                        shadingBreps.append(face.DuplicateFace(False))
                
                for faceCount, shdBrep in enumerate(shadingBreps):
                        thisShading = hb_EPSHDSurface(shdBrep, 1000*brepCount + faceCount, 'shdSrf_' + `brepCount` + '_' + `faceCount` + "_" + str(uuid.uuid4()))
                        
                        # add transmittance schedule if any
                        if EPTransSchedule!=None:
                            schedule= EPTransSchedule.upper()
                            if schedule!=None and not schedule.lower().endswith(".csv") and schedule not in HBScheduleList:
                                msg = "Cannot find " + schedule + " in Honeybee schedule library."
                                print msg
                                ghenv.Component.AddRuntimeMessage(gh.GH_RuntimeMessageLevel.Warning, msg)
                                return -1
                            elif schedule!=None and schedule.lower().endswith(".csv"):
                                # check if csv file is existed
                                if not os.path.isfile(schedule):
                                    msg = "Cannot find the shchedule file: " + schedule
                                    print msg
                                    ghenv.Component.AddRuntimeMessage(gh.GH_RuntimeMessageLevel.Warning, msg)
                                    return -1
                            
                            thisShading.TransmittanceSCH = schedule
                        
                        # add the Rad Material if any
                        if RADMaterial!=None:
                            # if it is just the name of the material make sure it is already defined
                            if len(RADMaterial.split(" ")) == 1:
                                # if the material is not in the library add it to the library
                                if not hb_RADMaterialAUX.isMatrialExistInLibrary(RADMaterial):
                                    warningMsg = "Can't find " + RADMaterial + " in RAD Material Library.\n" + \
                                                "Add the material to the library and try again."
                                    ghenv.Component.AddRuntimeMessage(gh.GH_RuntimeMessageLevel.Warning, warningMsg)
                                    return
                                
                                try:
                                    thisShading.setRADMaterial(RADMaterial)
                                except Exception, e:
                                    print e
                                    warningMsg = "You are using an old version of Honeybee_Honeybee! Update your files and try again."
                                    print warningMsg
                                    ghenv.Component.AddRuntimeMessage(gh.GH_RuntimeMessageLevel.Warning, warningMsg)
                                    return
                                
                                addedToLib = True
                            else:
                                
                                # try to add the material to the library
                                addedToLib, thisShading.RadMaterial = hb_RADMaterialAUX.analyseRadMaterials(RADMaterial, True)
                                
                            if addedToLib==False:
                                warningMsg = "Failed to add " + RADMaterial + " to the Library."
                                ghenv.Component.AddRuntimeMessage(gh.GH_RuntimeMessageLevel.Warning, warningMsg)
                                return
                        
                        # add shading to the list
                        shadingClasses.append(thisShading)
                
        # add to the hive
        hb_hive = sc.sticky["honeybee_Hive"]()
        HBContext  = hb_hive.addToHoneybeeHive(shadingClasses, ghenv.Component)
        return HBContext
        ################################################################################################
    else:
        print "You should first let Honeybee to fly..."
        w = gh.GH_RuntimeMessageLevel.Warning
        ghenv.Component.AddRuntimeMessage(w, "You should first let Honeybee to fly...")
        return -1
        

if _shdSurfaces and _shdSurfaces[0]!=None:
    # add cleaning function
    result= main(_shdSurfaces, EPTransSchedule_, meshingSettings_, justBoundingBox_)
    
    if result != -1: HBContext = result
# ---------- end hb_epcontextsrf ----------
wires = BrepWireframe(Brep=buildings, Density=-1)  # disabled
toggle_10 = BooleanToggle(False)  # disabled
toggle_11 = BooleanToggle(False)  # disabled
toggle_12 = BooleanToggle(True)  # disabled
toggle_13 = BooleanToggle(True)  # disabled
panel_16 = Panel("4")  # disabled
geo_16 = Geometry(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)  # disabled
wires_2 = BrepWireframe(Brep=solveadjc.HBZonesWADJ, Density=-1)  # disabled
geo_17 = Geometry(solveadjc.HBZonesWADJ)  # disabled
indoorviewfactor = Honeybee_IndoorViewFactorCalculator(
    gridSize=panel_16,
    distFromFloorOrSrf=flatten(geo_16),
    includeOutdoor=toggle_11,
    parallel=toggle_12,
    buildMesh=toggle_13,
    runIt=toggle_13)  # -> readMe, port, viewFactorMesh, viewFactorInfo, port_2, testPts, viewMeshFaces, zoneWireFrame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; disabled; plug-in component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
exporttoopenstudio = Honeybee_ExportToOpenStudio(
    epwWeatherFile=epw_stat_2.epwFile,
    analysisPeriod=importstat_2.extremeHotWeek,
    HBZones=flatten(solveadjc.HBZonesWADJ),
    HBContext=flatten(hb_epcontextsrf),
    simulationOutputs=flatten(panel_15),
    writeOSM=toggle_10,
    runSimulation=toggle_10)  # -> readMe, osmFileAddress, idfFileAddress, resultsFileAddress, eioFileAddress, rddFileAddress, studyFolder; disabled; plug-in component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
toggle_14 = BooleanToggle(True)  # disabled
panel_17 = Panel("8")  # disabled
# Define The City
panel_18 = Panel("0.1")  # disabled
swatch_2 = ColourSwatch(SwatchColor=RGB(255, 255, 255))  # disabled
uwgcityfromtypology = Dragonfly_UWGCityFromTypologies(
    buildingTypologies=flatten(commercialtypology),
    buildingBreps=flatten(buildings),
    pavementBrep=flatten(pavement),
    treesOrCoverage=flatten(panel_18),
    nonBldgHeat=panel_17,
    runIt=toggle_14)  # -> readMe, port, UWGCity, port_2, joinedBldgs, bldgFootprints, treeFootprints, pavementSrf, grassSrf; disabled; plug-in component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
vdisex = VectorDisplayEx(Point=indoorviewfactor.testPts, Vector=indoorviewfactor.viewVectors, Colour=swatch_2, Width=2)  # disabled
readepsrfresult = Honeybee_ReadEPSurfaceResult(resultFileAddress=exporttoopenstudio.resultsFileAddress)  # -> surfaceIndoorTemp, surfaceOutdoorTemp, surfaceEnergyFlow, opaqueEnergyFlow, glazEnergyFlow, windowTotalSolarEnergy, windowBeamEnergy, windowDiffEnergy, windowTransmissivity, otherSurfaceData; disabled; plug-in component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
panel_19 = Panel(uwgcityfromtypology.readMe)  # disabled
toggle_15 = BooleanToggle(True)  # disabled
colorsurfaces = Honeybee_ColorSurfacesByEPResult(srfData=readepsrfresult.surfaceOutdoorTemp, HBZones=flatten(solveadjc.HBZonesWADJ), runIt=toggle_15)  # -> readMe, srfColoredMesh, zoneWireFrame, legend, legendBasePt, analysisTitle, srfBreps, srfColors, srfValues, normalizedSrfData; disabled; plug-in component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
toggle_16 = BooleanToggle(True)  # disabled
panel_20 = Panel("SingaporeSite")  # disabled
# Run the UWG
extreme_hot_week = Data(importstat.extremeHotWeek)  # disabled
area = Area(Geometry=colorsurfaces.srfBreps)  # -> Area, Centroid; disabled
tag = TextTag(Location=area.Centroid, Text=colorsurfaces.srfValues)  # disabled
runuwg = Dragonfly_RunUrbanWeatherGenerator(
    epwFile=epw_stat.epwFile,
    UWGCity=uwgcityfromtypology.UWGCity,
    analysisPeriod=extreme_hot_week,
    writeXML=toggle_16,
    runUWG=toggle_16,
    xmlFileName=panel_20)  # -> readMe, xmlText, xmlFileAddress, epwFileAddress; disabled; plug-in component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
original_weather_file = Data(epw_stat.epwFile)  # disabled

# ----
# Import Rural + Urban EPWs
importepw = Ladybug_ImportEpw(epwFile=original_weather_file)  # -> readMe, latitude, location, dryBulbTemperature, dewPointTemperature, relativeHumidity, windSpeed, windDirection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; disabled; plug-in component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
selectandaveragedata = Ladybug_AverageData(annualHourlyData=importepw.dryBulbTemperature, analysisPeriod=extreme_hot_week)  # -> readMe, selHourlyData, averagedDaily, averagedMonthly, avrMonthlyPerHour, avrAnalysisPeriod; disabled; plug-in component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

importepw_2 = Ladybug_ImportEpw(epwFile=runuwg.epwFileAddress)  # -> readMe, latitude, location, dryBulbTemperature, dewPointTemperature, relativeHumidity, windSpeed, windDirection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; disabled; plug-in component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
selectandaveragedata_2 = Ladybug_AverageData(annualHourlyData=importepw_2.relativeHumidity, analysisPeriod=extreme_hot_week)  # -> readMe, selHourlyData, averagedDaily, averagedMonthly, avrMonthlyPerHour, avrAnalysisPeriod; disabled; plug-in component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
selectandaveragedata_3 = Ladybug_AverageData(annualHourlyData=importepw_2.dryBulbTemperature, analysisPeriod=extreme_hot_week)  # -> readMe, selHourlyData, averagedDaily, averagedMonthly, avrMonthlyPerHour, avrAnalysisPeriod; disabled; plug-in component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

selectandaveragedata_4 = Ladybug_AverageData(annualHourlyData=importepw.relativeHumidity, analysisPeriod=extreme_hot_week)  # -> readMe, selHourlyData, averagedDaily, averagedMonthly, avrMonthlyPerHour, avrAnalysisPeriod; disabled; plug-in component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

toggle_17 = BooleanToggle(True)  # disabled
outdoorcomfortcalculator = Ladybug_OutdoorComfortCalculator(
    dryBulbTemperature=selectandaveragedata_3.selHourlyData,
    relativeHumidity=selectandaveragedata_2.selHourlyData,
    runIt=toggle_17)  # -> readMe, port, universalThermalClimateIndex, comfortableOrNot, thermalStress, conditionOfPerson, port_2, percentOfTimeComfortable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; disabled; plug-in component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
# Look at the Effect of UHI on Outdoor Comfort
outdoorcomfortcalculator_2 = Ladybug_OutdoorComfortCalculator(
    dryBulbTemperature=selectandaveragedata.selHourlyData,
    relativeHumidity=selectandaveragedata_4.selHourlyData,
    runIt=toggle_17)  # -> readMe, port, universalThermalClimateIndex, comfortableOrNot, thermalStress, conditionOfPerson, port_2, percentOfTimeComfortable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; disabled; plug-in component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
panel_21 = Panel(outdoorcomfortcalculator_2.percentHeatStress)  # disabled
panel_22 = Panel(outdoorcomfortcalculator.percentHeatStress)  # disabled

strnum = Ladybug_SeparateData(inputList=flatten(selectandaveragedata_3.selHourlyData))  # -> numbers, strings; disabled; plug-in component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
# Look at Maximum and Average UHI
strnum_2 = Ladybug_SeparateData(inputList=flatten(selectandaveragedata.selHourlyData))  # -> numbers, strings; disabled; plug-in component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
avr = Average(Input=strnum.numbers)  # disabled
avr_2 = Average(Input=strnum_2.numbers)  # disabled
subtraction = Subtraction(A=strnum.numbers, B=strnum_2.numbers)  # disabled
subtraction_2 = Subtraction(A=avr, B=avr_2)  # disabled
sort = SortList(Keys=subtraction)  # -> Keys, ValuesA; disabled
rev = ReverseList(List=sort.Keys)  # disabled
item = ListItem(List=rev, Index=0, Wrap=True)  # disabled
maximum_uhi_c = Panel(item)  # disabled
avg_uhi_c = Panel(subtraction_2)  # disabled

panel_23 = Panel("-250")  # disabled
panel_24 = Panel("300")  # disabled
pt = ConstructPoint(XCoordinate=panel_24, YCoordinate=0, ZCoordinate=panel_23)  # disabled
_3dchart = Ladybug_3DChart(
    inputData=flatten([outdoorcomfortcalculator_2.universalThermalClimateIndex, outdoorcomfortcalculator.universalThermalClimateIndex]),
    basePoint=pt)  # -> readMe, graphMesh, graphCurves, legend, legendBasePts, title, titleBasePts, dataPts, conditionalHOY; disabled; plug-in component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
