# Grasshopper definition straight_skeleton_algorithm_2.gh (Grasshopper 0.9.76)
# plug-ins: Python Interpreter

list = ValueList({"dir", "file"}, selected="dir")
geo = Geometry(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)
geo_2 = Geometry(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)
geo_3 = Geometry(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)
geo_4 = Geometry(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)
geo_5 = Geometry(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)
geo_6 = Geometry(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)

# ---- group: find directory
bibil = PythonScript(dir=["C:\\master\\git\\bibil\\src", "C:\Users\631\Documents\GitHub\Bibil\src"], type=list, run=Toggle(True))  # -> dir; inputs dir: list
# ---------- bibil: Python ----------
import os
import sys

ghenv.Component.Params.Output[0].Name = "null"
ghenv.Component.Params.Output[0].NickName = "null"

#sys.path.append("C:\Program Files\Rhinoceros 5.0 (64-bit)\System")

if run:
    confirm_dir = None
    for d in dir:
        try:
            if type == "file":
                file_ = open(d)
                file_.close()
            else:
                print os.listdir(d)
            confirm_dir = d
            break
        except Exception as e:
            #print str(e)
            continue
    if confirm_dir != None:
        ghenv.Component.Params.Output[0].Name = type
        ghenv.Component.Params.Output[0].NickName = type
        dir = confirm_dir
        file = confirm_dir
null = None
# ---------- end bibil ----------

# ----
vec = VectorXYZ(XComponent=0, YComponent=0, ZComponent=Slider(6, range=0..100))  # -> Vector, Length
geo_7 = Geometry(geo)
extr = Extrude(Base=geo_7, Direction=vec.Vector)

# ---- group: straight_skeleton
python_script = PythonScript(i=bibil)  # -> o
# ---------- python_script: Python ----------
import os

if i:
    o = os.path.join(str(i),"miru\\miru_straight_skeleton.py")
# ---------- end python_script ----------
file = ReadFile(File=python_script, PerLineParse=False)

# ----
capex = CapHolesEx(Brep=extr)  # -> Brep, Caps, Solid

# ---- group: tree
python_script_2 = PythonScript(i=bibil)  # -> o
# ---------- python_script_2: Python ----------
import os

if i:
    o = os.path.join(str(i),"bibil\\bibil_tree.py")
# ---------- end python_script_2 ----------
file_2 = ReadFile(File=python_script_2, PerLineParse=False)
bibil_2 = PythonScript(Code=file_2)

# ---- group: grammar
python_script_3 = PythonScript(i=bibil)  # -> o
# ---------- python_script_3: Python ----------
import os

if i:
    o = os.path.join(str(i),"bibil\\bibil_grammar.py")
# ---------- end python_script_3 ----------
file_3 = ReadFile(File=python_script_3, PerLineParse=False)
bibil_3 = PythonScript(Code=file_3)

# ---- group: shape
python_script_4 = PythonScript(i=bibil)  # -> o
# ---------- python_script_4: Python ----------
import os

if i:
    o = os.path.join(str(i),"bibil\\bibil_shape.py")
#o = os.path.join(str(i),"research\\bibil_shape_shape_3d_2d.py")
# ---------- end python_script_4 ----------
file_4 = ReadFile(File=python_script_4, PerLineParse=False)
bibil_4 = PythonScript(Code=file_4)

# ---- group: UI
python_script_5 = PythonScript(i=bibil)  # -> o
# ---------- python_script_5: Python ----------
import os

if i:
    o = os.path.join(str(i),"bibil\\bibil_UI.py")
# ---------- end python_script_5 ----------
file_5 = ReadFile(File=python_script_5, PerLineParse=False)

# ---- group: grammar_divide
python_script_6 = PythonScript(i=bibil)  # -> o
# ---------- python_script_6: Python ----------
import os

if i:
    o = os.path.join(str(i),"miru\\miru_divide.py")
# ---------- end python_script_6 ----------
file_6 = ReadFile(File=python_script_6, PerLineParse=False)

# ---- group: grammar_courtyard
python_script_7 = PythonScript(i=bibil)  # -> o
# ---------- python_script_7: Python ----------
import os

if i:
    o = os.path.join(str(i),"miru\\miru_court.py")
# ---------- end python_script_7 ----------
file_7 = ReadFile(File=python_script_7, PerLineParse=False)

# ---- group: grammar_tower
python_script_8 = PythonScript(i=bibil)  # -> o
# ---------- python_script_8: Python ----------
import os

if i:
    o = os.path.join(str(i),"miru\\miru_packing.py")
# ---------- end python_script_8 ----------
file_8 = ReadFile(File=python_script_8, PerLineParse=False)

# ---- group: stepback
python_script_9 = PythonScript(i=bibil)  # -> o
# ---------- python_script_9: Python ----------
import os

if i:
    o = os.path.join(str(i),"miru\\miru_stepback.py")
# ---------- end python_script_9 ----------
file_9 = ReadFile(File=python_script_9, PerLineParse=False)

# ---- group: grammar_height
python_script_10 = PythonScript(i=bibil)  # -> o
# ---------- python_script_10: Python ----------
import os

if i:
    o = os.path.join(str(i),"miru\\miru_height.py")
# ---------- end python_script_10 ----------
file_10 = ReadFile(File=python_script_10, PerLineParse=False)

# ---- group: grammar_analysis_pts
python_script_11 = PythonScript(i=bibil)  # -> o
# ---------- python_script_11: Python ----------
import os

if i:
    o = os.path.join(str(i),"miru\\miru_analysis.py")
# ---------- end python_script_11 ----------
file_11 = ReadFile(File=python_script_11, PerLineParse=False)

# ---- group: meta_tree
python_script_12 = PythonScript(i=bibil)  # -> o
# ---------- python_script_12: Python ----------
import os

if i:
    o = os.path.join(str(i),"miru\\miru_meta_tree.py")
# ---------- end python_script_12 ----------
file_12 = ReadFile(File=python_script_12, PerLineParse=False)

# ---- group: land_use
python_script_13 = PythonScript(i=bibil)  # -> o
# ---------- python_script_13: Python ----------
import os

if i:
    o = os.path.join(str(i),"miru\\miru_landuse.py")
# ---------- end python_script_13 ----------
file_13 = ReadFile(File=python_script_13, PerLineParse=False)

# ---- group: shape2height
python_script_14 = PythonScript(i=bibil)  # -> o
# ---------- python_script_14: Python ----------
import os

if i:
    o = os.path.join(str(i),"miru\\miru_shape2height.py")
# ---------- end python_script_14 ----------
file_14 = ReadFile(File=python_script_14, PerLineParse=False)

# ---- group: extract_slice
python_script_15 = PythonScript(i=bibil)  # -> o
# ---------- python_script_15: Python ----------
import os

if i:
    o = os.path.join(str(i),"miru\\miru_extract_slice.py")
# ---------- end python_script_15 ----------
file_15 = ReadFile(File=python_script_15, PerLineParse=False)

# ---- group: pyeuclid
python_script_16 = PythonScript(i=bibil)  # -> o
# ---------- python_script_16: Python ----------
import os

if i:
    o = os.path.join(str(i),"bibil\\pyeuclid.py")
# ---------- end python_script_16 ----------
file_16 = ReadFile(File=python_script_16, PerLineParse=False)
bibil_5 = PythonScript(Code=file_16)

# ---- group: bula
python_script_17 = PythonScript(i=bibil)  # -> o
# ---------- python_script_17: Python ----------
import os

if i:
    o = os.path.join(str(i),"bula\\bula_minimal.py")
# ---------- end python_script_17 ----------
file_17 = ReadFile(File=python_script_17, PerLineParse=False)
bibil_6 = PythonScript(Code=file_17)

# ----
number_slider = Slider(30, range=0..100)
geo_8 = Geometry(capex.Brep)
number_slider_2 = Slider(11, range=0..100)
number_slider_3 = Slider(2, range=0..10)

# ---- group: straight_skeleton
miru = PythonScript(Code=file, PerimeterZoneDepth_=number_slider, Step=Slider(25, range=0..100), Run=Toggle(True))

# ----
honeybee = Honeybee_Honeybee()  # -> Vviiiiiiiiiizzz; plug-in component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
ladybug = Ladybug_Ladybug()  # -> Vviiiiiiiiiizzz; plug-in component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
splitmass = Honeybee_SplitBuildingMass(bldgMasses=geo_8, perimeterZoneDepth=number_slider, runIt=Toggle(False))  # -> readMe, splitBldgMasses; plug-in component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
geo_9 = Geometry([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])
geo_10 = Geometry([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])
pt = Point(Point(-431.1114305, 136.9235945, 0))
pt_2 = Point(Point(-563.9556526, 25.81200591, 0))
dash = DashPattern(Curve=geo_9, Pattern=Slider(1, range=0..10))  # -> Dashes, Gaps
neg = Negative(Value=Slider(119, range=0..1000))
preview = CustomPreview(
    Geometry=dash.Dashes,
    Shader={ambient=RGB(0, 0, 0), diffuse=RGB(255, 105, 180), emission=RGB(76, 32, 54), shine=0.5, specular=RGB(255, 255, 255), transparency=0})
vec_2 = VectorXYZ(XComponent=neg, YComponent=0, ZComponent=0)  # -> Vector, Length
move = Move(Geometry=geo_7, Motion=vec_2.Vector)  # -> Geometry, Transform
wires = BrepWireframe(Brep=[move.Geometry, geo_7], Density=-1)
preview_2 = CustomPreview(Geometry=wires, Shader=ColourSwatch(SwatchColor=RGB(0, 0, 0)))
vec2pt = Vector2Pt(PointA=pt, PointB=pt_2, Unitize=False)  # -> Vector, Length

# ---- group: SHAPENODE
bibil_7 = PythonScript(Code=file_5, Rule_in=flatten(miru), Node_in=flatten(geo_8), Run=Toggle(True))  # -> Node_out, Debug

# ----
geo_11 = Geometry(bibil_7.Debug)
move_2 = Move(Geometry=splitmass.splitBldgMasses, Motion=vec_2.Vector)  # -> Geometry, Transform
g = PythonScript(node=bibil_7.Node_out)  # -> pt, txt; inputs node: list
# ---------- g: Python ----------
node = filter(lambda n: n!=None,node)
if node and node != []:
    pt = []
    txt = []
    for n in node:
        if n.grammar.type.has_key('idlst'):
            txt = n.grammar.type['idlst']
            pt = n.grammar.type['ptlst']
    print txt
# ---------- end g ----------
geo_12 = Geometry(move_2.Geometry)
tag = TextTag3D(
    Location=g.pt,
    Text=g.txt,
    Size=Slider(5, range=0..10),
    Colour=ColourSwatch(SwatchColor=RGB(0, 255, 97)),
    Justification=5)
panel = Panel(bibil_7.Debug)
preview_3 = CustomPreview(Geometry=geo_11, Shader=ColourSwatch(SwatchColor=RGB(0, 255, 0)))
wires_2 = BrepWireframe(Brep=[geo_11, geo_12], Density=-1)  # disabled
preview_4 = CustomPreview(Geometry=wires_2, Shader=ColourSwatch(SwatchColor=RGB(0, 0, 0)))
