# Grasshopper definition bibil_trial_069.gh (Grasshopper 0.9.76)
# plug-ins: Python Interpreter, Mosquito

list = ValueList({"dir", "file"}, selected="dir")

# ---- group: find directory
bibil = PythonScript(
    dir=["C:\\Users\\vasanthakumars\\Documents\\GitHub\\bibil\\src", "C:\\saeran\\master\\git\\bibil\\src"],
    type=list,
    run=Toggle(True))  # -> dir; inputs dir: list
# ---------- bibil: Python ----------
import os

ghenv.Component.Params.Output[0].Name = "null"
ghenv.Component.Params.Output[0].NickName = "null"

if run:
    confirm_dir = None
    for d in dir:
        try:
            if type == "file":
                print open(d)
            else:
                print os.listdir(d)
            confirm_dir = d
            break
        except Exception as e:
            #print str(e)
            continue
    if confirm_dir != None:
        ghenv.Component.Params.Output[0].Name = type
        ghenv.Component.Params.Output[0].NickName = type
        dir = confirm_dir
null = None
# ---------- end bibil ----------

# ---- group: miru
# BIBIL_CLASSES
python_script = PythonScript(i=bibil)  # -> o
# ---------- python_script: Python ----------
import os

if i:
    o = os.path.join(str(i),"miru\\miru_miru.py")
# ---------- end python_script ----------
file = ReadFile(File=python_script, PerLineParse=False)
bibil_2 = PythonScript(Code=file)

# ---- group: grammar
python_script_2 = PythonScript(i=bibil)  # -> o
# ---------- python_script_2: Python ----------
import os

if i:
    o = os.path.join(str(i),"bibil\\bibil_rule.py")
# ---------- end python_script_2 ----------
file_2 = ReadFile(File=python_script_2, PerLineParse=False)
bibil_3 = PythonScript(Code=file_2)

# ---- group: pattern
python_script_3 = PythonScript(i=bibil)  # -> o
# ---------- python_script_3: Python ----------
import os

if i:
    o = os.path.join(str(i),"bibil\\bibil_pattern.py")
# ---------- end python_script_3 ----------
file_3 = ReadFile(File=python_script_3, PerLineParse=False)
bibil_4 = PythonScript(Code=file_3)

# ---- group: shape
python_script_4 = PythonScript(i=bibil)  # -> o
# ---------- python_script_4: Python ----------
import os

if i:
    o = os.path.join(str(i),"bibil\\bibil_shape.py")
#o = os.path.join(str(i),"research\\bibil_shape_shape_3d_2d.py")
# ---------- end python_script_4 ----------
file_4 = ReadFile(File=python_script_4, PerLineParse=False)
bibil_5 = PythonScript(Code=file_4)

# ---- group: tree
python_script_5 = PythonScript(i=bibil)  # -> o
# ---------- python_script_5: Python ----------
import os

if i:
    o = os.path.join(str(i),"bibil\\bibil_tree.py")
# ---------- end python_script_5 ----------
file_5 = ReadFile(File=python_script_5, PerLineParse=False)
bibil_6 = PythonScript(Code=file_5)

# ---- group: bula
python_script_6 = PythonScript(i=bibil)  # -> o
# ---------- python_script_6: Python ----------
import os

if i:
    o = os.path.join(str(i),"bula\\bula_point.py")
# ---------- end python_script_6 ----------
file_6 = ReadFile(File=python_script_6, PerLineParse=False)

# ---- group: node_comp
python_script_7 = PythonScript(i=bibil)  # -> o
# ---------- python_script_7: Python ----------
import os

if i:
    o = os.path.join(str(i),"bibil\\bibil_plain.py")
# ---------- end python_script_7 ----------
file_7 = ReadFile(File=python_script_7, PerLineParse=False)

# ---- group: grammar_divide
python_script_8 = PythonScript(i=bibil)  # -> o
# ---------- python_script_8: Python ----------
import os

if i:
    o = os.path.join(str(i),"miru\\miru_divide.py")
# ---------- end python_script_8 ----------
file_8 = ReadFile(File=python_script_8, PerLineParse=False)

# ---- group: grammar_courtyard
python_script_9 = PythonScript(i=bibil)  # -> o
# ---------- python_script_9: Python ----------
import os

if i:
    o = os.path.join(str(i),"miru\\miru_court.py")
# ---------- end python_script_9 ----------
file_9 = ReadFile(File=python_script_9, PerLineParse=False)

# ---- group: grammar_tower
python_script_10 = PythonScript(i=bibil)  # -> o
# ---------- python_script_10: Python ----------
import os

if i:
    o = os.path.join(str(i),"miru\\miru_packing.py")
# ---------- end python_script_10 ----------
file_10 = ReadFile(File=python_script_10, PerLineParse=False)

python_script_11 = PythonScript(i=bibil)  # -> o
# ---------- python_script_11: Python ----------
import os

if i:
    o = os.path.join(str(i),"miru\\miru_stepback.py")
# ---------- end python_script_11 ----------
file_11 = ReadFile(File=python_script_11, PerLineParse=False)

# ---- group: grammar_height
python_script_12 = PythonScript(i=bibil)  # -> o
# ---------- python_script_12: Python ----------
import os

if i:
    o = os.path.join(str(i),"miru\\miru_height.py")
# ---------- end python_script_12 ----------
file_12 = ReadFile(File=python_script_12, PerLineParse=False)

# ----
# Note: Change this number with caution,
# Increase bounds iterratively.
panel = Panel("0.004")  # disabled

panel_2 = Panel("Yonge and Eglinton")  # disabled
panel_3 = Panel("Redpath Avenue and Roehampton Avenue")  # disabled
location = MosquitoLocation(Location=panel_3)  # -> Address, Points, Type; disabled
item = ListItem(List=location.Points, Index=0, Wrap=True)  # disabled
toggle = BooleanToggle(True)  # disabled
toggle_2 = BooleanToggle(True)  # disabled
toggle_3 = BooleanToggle(True)  # disabled
toggle_4 = BooleanToggle(True)  # disabled
circle = CircleCNR(Center=item, Normal=Vector(0, 0, 1), Radius=panel)  # disabled
vector_maps = VectorMaps(Area=circle, AllRoads=toggle, Buildings=toggle_2, ReProject=toggle_3, CenterToWorld=toggle_4)  # -> RoadLines, RoadInfo, BuildingLines, BuildingInfo, BuildingHeights, AmenityLines, AmenityInfo, AmenityPoints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; disabled
swatch = ColourSwatch(SwatchColor=RGB(0, 0, 0))  # disabled
geo = Geometry([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])  # disabled
geo_2 = Geometry([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])  # disabled
geo_3 = Geometry(Tree({0}: [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], {1}: [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], {2}: [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], {3}: [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], {4}: [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], {5}: [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]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))  # disabled
geo_4 = Geometry([vector_maps.BuildingLines, vector_maps.RoadLines, vector_maps.AmenityLines])  # disabled
preview = CustomPreview(Geometry=[geo_3, geo_2, geo], Shader=swatch)  # disabled

geo_5 = Geometry([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])
geo_6 = Geometry([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])
geo_7 = Geometry([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])
preview_2 = CustomPreview(
    Geometry=geo_7,
    Shader={ambient=RGB(0, 0, 0), diffuse=RGB(255, 105, 180), emission=RGB(76, 32, 54), shine=0.5, specular=RGB(255, 255, 255), transparency=0})
preview_3 = CustomPreview(Geometry=[geo_6, geo_5], Shader=ColourSwatch(SwatchColor=RGB(0, 0, 0)))

# ----
# LOT GRAMMAR
number_slider = Slider(1, range=0..10)
list_2 = ValueList({"divide by depth": "subdivide_depth", "divide by same depth": "subdivide_depth_same", "divide by dim": "subdivide_dim"}, selected="divide by same depth")
list_3 = ValueList({"YZ": "NS", "XZ": "EW", "XY": "Z"}, selected="XZ")

# ---- group: DIVIDE
bibil_7 = PythonScript(
    Code=file_8,
    Divide_num=number_slider,
    Divide_cut=Slider(9, range=0..100),
    Divide_type=list_2,
    Divide_ratio=Slider(0.5, range=0..1),
    Axis=list_3,
    Run=Toggle(False))

# ----
geo_8 = Geometry(<curve referenced from the Rhino model>)
trinco_park = PythonScript(Code=file_7, Rule_in=bibil_7, Child_node_in=geo_8, Label_="street", Run=Toggle(True))  # -> Node_out, Debug
g = PythonScript(node=trinco_park.Node_out)  # -> geom; inputs node: list
# ---------- g: Python ----------
if node and node != []:
    geom = []
    #lot_lst = node.traverse_tree(lambda n:n,internal=False)
    for n in node:
        geom.append(n.data.shape.bottom_crv)
    print geom
# ---------- end g ----------
explode = Explode(Curve=geo_8, Recursive=True)  # -> Segments, Vertices
geo_9 = Geometry(explode.Segments)
# BUILDING GRAMMAR
number_slider_2 = Slider(24, range=0..100)
# TOWER GRAMMAR
toggle_5 = BooleanToggle(False)

# ---- group: COURTYARD
miru = PythonScript(Code=file_9, Podium_depth=Slider(21, range=0..100), Node_depth=Slider(1, range=-1..1), Run=Toggle(False))

# ---- group: PACKING
bibil_8 = PythonScript(Code=file_10, Run=toggle_5)

# ---- group: SETBACK/STEPBACK
miru_2 = PythonScript(
    Code=file_11,
    Height=Slider(15, range=0..100),
    Distance=Slider(6, range=0..10),
    Geom_ref=geo_9,
    Node_ref="-1",
    Run=Toggle(True))

# ---- group: HEIGHT
miru_3 = PythonScript(Code=file_12, Height=number_slider_2, Run=Toggle(True))

# ---- group: SETBACK/STEPBACK
miru_4 = PythonScript(
    Code=file_11,
    Height=Slider(9, range=0..10),
    Distance=Slider(3, range=0..10),
    Geom_ref=geo_9,
    Node_ref="-1",
    Run=Toggle(True))

# ----
bibil_9 = PythonScript(
    Code=file_7,
    Rule_in=[miru_3, miru, miru_4, miru_2],
    Child_node_in=trinco_park.Node_out,
    Label_="podium",
    Run=Toggle(False))  # -> Node_out, Debug
g_2 = PythonScript(node=bibil_9.Node_out)  # -> geom
# ---------- g_2: Python ----------
if node:
    geom = []
    lot_lst = node.traverse_tree(lambda n:n,internal=False)
    for n in lot_lst:
        geom.append(n.data.shape.geom)
    print geom
# ---------- end g_2 ----------
list_4 = ValueList({"divide by depth": "subdivide_depth", "divide by same depth": "subdivide_depth_same", "divide by dim": "subdivide_dim"}, selected="divide by same depth")
geo_10 = Geometry([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])
list_5 = ValueList({"YZ": "NS", "XZ": "EW", "XY": "Z"}, selected="XZ")

# ---- group: DIVIDE
bibil_10 = PythonScript(
    Code=file_8,
    Divide_num=Slider(1, range=0..10),
    Divide_cut=Slider(9, range=0..100),
    Divide_type=list_4,
    Divide_ratio=Slider(0.5, range=0..1),
    Axis=list_5,
    Run=Toggle(False))

# ----
bibil_11 = PythonScript(Code=file_7, Child_node_in=geo_10, Label_="floor", Run=Toggle(True))  # -> Node_out, Debug
pt = Point()
transit_dpt = Point(Point(-545356.282, 3981726.697, 0))
transit_dpt_2 = Point(Point(-546019.3338, 3981540.172, 0))
geo_11 = Geometry(<curve referenced from the Rhino model>)
g_3 = PythonScript(node=bibil_11.Node_out)  # -> geom
# ---------- g_3: Python ----------
if node:
    geom = []
    lot_lst = node.traverse_tree(lambda n:n,internal=False)
    for n in lot_lst:
        geom.append(n.data.shape.bottom_crv)
    #print geom
# ---------- end g_3 ----------
g_4 = PythonScript(node=bibil_11.Node_out)  # -> ht
# ---------- g_4: Python ----------
if node:
    ht = []
    lot_lst = node.traverse_tree(lambda n:n,internal=False)
    for n in lot_lst:
        ht.append(n.data.shape.ht)
    print ht
# ---------- end g_4 ----------
trinco_park_2 = PythonScript(Code=file_7, Rule_in=bibil_10, Child_node_in=geo_11, Label_="street", Run=Toggle(True))  # -> Node_out, Debug
geo_12 = Geometry(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)
num = Number(1)
quick_ca_abm = PythonScript(pts=pt, dpt_major=transit_dpt_2, dpt_minor=transit_dpt, power=num, boundary=geo_12)  # -> line, cpt, txt; inputs pts: list, dpt_major: Point3d, power: Int32, iterate: list
# ---------- quick_ca_abm: Python ----------
"""
Copyright (C) Saeran Vasanthakumar - All Rights Reserved
Unauthorized copying of this file, via any medium is strictly prohibited
Proprietary and confidential
Written by Saeran Vasanthakumar <saeranv@gmail.com>, May 2016
"""

import rhinoscriptsyntax as rs
import math

def normalize_list(lov,lobound,hibound):
    ### normalized_val = ( (val-min)*(hibound-lobound) )/(max-min) + lobound
    max_ = max(lov)
    min_ = min(lov)
    L = []
    for i,v in enumerate(lov):
        norm_val = ((hibound-lobound)*(v-min_))/(max_-min_) + lobound
        L.append(norm_val)
    return L
def get_distance(pts_,dpt_major,dpt_minor):
    YEL = []
    MPL = []#parallel list of which points is chosen
    for pt in pts_:
        dlst = []
        distmajor = rs.Distance(pt,dpt_major)
        distminor = rs.Distance(pt,dpt_minor)
        YEL.append(distmajor)
        MPL.append(distminor)
    return YEL,MPL
    
def get_uniformity(YL,ML,iterate_,power_):
    val_lst = [] 
    norm_dist_yonge = normalize_list(YL,0.,1.0)
    norm_dist_mount = normalize_list(ML,0.,3.0)
    #YL = normalize_list(YL,0.,20.)
    #ML = normalize_list(ML,0.,20.)
    for it in iterate_:
        #print 'iterate', it
        for i,dist in enumerate(zip(YL,ML)):
            y = dist[0]
            m = dist[1]
            divfact = 75.
            powfact = 1.1
            factor = factor =  math.pow(abs(y-m)/divfact,powfact)
            if y<m:
                try:
                    y = norm_dist_yonge[i]
                    z = y#25 * (1/math.pow(y,it))
                    z = 25 * (1/math.pow(y,it))
                except ZeroDivisionError:
                    z = 0.
            else:
                try:
                    m = norm_dist_mount[i]
                    #z = m#25 * (1/math.pow(m,it))
                    z = 25 * (1/math.pow(m,it))
                except ZeroDivisionError:
                    z = 0.
            z *= factor/6.
            #z += 0.
            """
            try:
                factor = 
                z = 25 * (1/math.pow(factor,it))
            except ZeroDivisionError:
                z = 0.
            """
            val_lst.append(z)
            #25 multiplier stretches it out
            ##old
            #z = 10./math.pow(float(d),float(it)/2.)
            # stretched out more when 10 outside
            #z = math.pow(10./float(d),float(it)/2.)
    return val_lst

def check_point_in_crv(crv,pt):
    rel = rs.PointInPlanarClosedCurve(pt,crv)
    if rel == 1: # inside curve
        return True
    else:
        return False
    
def make_line(zlst,ptlst):
    line_ = []
    for z,pt in zip(zlst,ptlst):
        rel = check_point_in_crv(boundary,pt)
       
        if rel == True:
            pt = rs.coerce3dpoint(pt)
            pt = rs.AddPoint(pt[0],pt[1],0)
            pt = rs.coerce3dpoint(pt)
            #if z < 0.001: z= 0.001
            toppt = rs.AddPoint(pt[0], pt[1], z)
            ln = rs.AddLine(pt,toppt)
            line_.append(rs.coerceline(ln))
    return line_
if True:
    
    YL,ML = get_distance(pts,dpt_major,dpt_minor)
    zdist = get_uniformity(YL,ML,iterate,power)
    line = make_line(zdist,pts)
# ---------- end quick_ca_abm ----------
g_5 = PythonScript(node=trinco_park_2.Node_out)  # -> geom; inputs node: list; same code as g
bula = PythonScript(Code=file_6)  # -> Lst_lots, Line, Debug
Z = UnitZ(Factor=g_4)
boundary = BoundarySurfaces(Edges=g_3)
list_6 = ValueList({"divide by depth": "subdivide_depth", "divide by same depth": "subdivide_depth_same", "divide by dim": "subdivide_dim"}, selected="divide by depth")
extr = Extrude(Base=boundary, Direction=Z)
list_7 = ValueList({"YZ": "NS", "XZ": "EW", "XY": "Z"}, selected="XZ")

# ---- group: DIVIDE
bibil_12 = PythonScript(
    Code=file_8,
    Divide_num=Slider(1, range=0..10),
    Divide_cut=Slider(0, range=0..100),
    Divide_type=list_6,
    Divide_ratio=Slider(0.5, range=0..1),
    Axis=list_7,
    Run=Toggle(False))

# ----
number_slider_3 = Slider(1, range=0..100)  # disabled
geo_13 = Geometry([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])  # disabled
ladybug = Ladybug_Ladybug()  # -> Vviiiiiiiiiizzz; plug-in component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
number_slider_4 = Slider(0, range=0..100)  # disabled
honeybee = Honeybee_Honeybee()  # -> Vviiiiiiiiiizzz; plug-in component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

# ---- group: Office
geo_14 = Geometry([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])  # disabled

# ----
createhbsrfs = Honeybee_createHBSrfs()  # -> readMe, simplify(HBSurface); disabled; plug-in component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
panel_4 = Panel("Ground")  # disabled
toggle_6 = BooleanToggle(False)  # disabled
listzoneprograms = Honeybee_ListZonePrograms(bldgProgram=number_slider_3)  # -> RetailZonePrograms; disabled; plug-in component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
listzoneprograms_2 = Honeybee_ListZonePrograms(bldgProgram=number_slider_4)  # -> OfficeZonePrograms; disabled; plug-in component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
number_slider_5 = Slider(3, range=0..10)
hb_epcontextsrf = HoneybeeEPContextSurfaces()  # -> HBContext; inputs shdSurfaces: list of Brep, justBoundingBox: Boolean; disabled
# ---------- hb_epcontextsrf: Python ----------
"""
prepare shading/context geometries

    Args:
        northVectorOrRotation: A vector that shows North or a number that shows
                               the rotation of the North from the Y axis
        bldgMasses: List of closed Breps as thermal zones.
    Returns:
        report: ...
        thermalZones: Thermal zone's geometries for visualiza
"""

ghenv.Component.Name = 'Honeybee EP context Surfaces'
ghenv.Component.NickName = 'HB_EPContextSrf'
ghenv.Component.Message = 'VER 0.0.60\nAUG_10_2016'
ghenv.Component.IconDisplayMode = ghenv.Component.IconDisplayMode.application
ghenv.Component.Category = "Honeybee"
ghenv.Component.SubCategory = "10 | Energy | Energy"
#compatibleHBVersion = VER 0.0.57\nNOV_01_2015
#compatibleLBVersion = VER 0.0.59\nFEB_01_2015
ghenv.Component.AdditionalHelpFromDocStrings = "2"

import rhinoscriptsyntax as rs
import Rhino as rc
import scriptcontext as sc
import os
import System
import Grasshopper.Kernel as gh
import uuid

tolerance = sc.doc.ModelAbsoluteTolerance
import math


def main(shdSurfaces, EPTransSchedule, meshingSettings, justBoundingBox):
    
    # import the classes
    if sc.sticky.has_key('honeybee_release'):

        try:
            if not sc.sticky['honeybee_release'].isCompatible(ghenv.Component): return -1
            if sc.sticky['honeybee_release'].isInputMissing(ghenv.Component): return -1
        except:
            warning = "You need a newer version of Honeybee to use this compoent." + \
            " Use updateHoneybee component to update userObjects.\n" + \
            "If you have already updated userObjects drag Honeybee_Honeybee component " + \
            "into canvas and try again."
            w = gh.GH_RuntimeMessageLevel.Warning
            ghenv.Component.AddRuntimeMessage(w, warning)
            return -1
        
        # don't customize this part
        hb_EPSrf = sc.sticky["honeybee_EPSurface"]
        hb_EPSHDSurface = sc.sticky["honeybee_EPShdSurface"]
        hb_RADMaterialAUX = sc.sticky["honeybee_RADMaterialAUX"]
        hb_EPObjectsAux = sc.sticky["honeybee_EPObjectsAUX"]()
        HBScheduleList = sc.sticky["honeybee_ScheduleLib"].keys()

        ########################################################################
        #----------------------------------------------------------------------#
        shdBreps = []
        # create bounding box of shading geometries
        if justBoundingBox:
            for brep in shdSurfaces:
                if brep.Faces.Count>1 or not brep.Faces[0].IsPlanar(sc.doc.ModelAbsoluteTolerance):
                    shdBreps.append(brep.GetBoundingBox(True).ToBrep())
                else:
                    shdBreps.append(brep)
        else:
            shdBreps = shdSurfaces
        
        shadingClasses = []
        shadingMeshPreview = []
        
        if meshingSettings == None:
            mp = rc.Geometry.MeshingParameters.Minimal
            mp.SimplePlanes = True
        else:
            mp = meshingSettings
        
        def getRadMaterialName(radMaterial):
            nameStr = radMaterial.split(" ")[2]
            name =  nameStr.split("\n")[0]
            return name
        
        for brepCount, brep in enumerate(shdBreps):
            if brep != None:
                isPlanar = True
                # check planarity
                for face in brep.Faces:
                    if not face.IsPlanar(tolerance):
                        isPlanar = False
                        break
                
                shadingBreps = []
                if not isPlanar:
                    meshArray = rc.Geometry.Mesh.CreateFromBrep(brep, mp)
                    for mesh in meshArray:
                        for meshFace in range(mesh.Faces.Count):
                            vertices = list(mesh.Faces.GetFaceVertices(meshFace))[1:]
                            vertices = vertices + [sc.doc.ModelAbsoluteTolerance]
                            # create the brep from mesh
                            shdBrep = rc.Geometry.Brep.CreateFromCornerPoints(*vertices)
                            shadingBreps.append(shdBrep)
                else:
                    for face in brep.Faces:
                        shadingBreps.append(face.DuplicateFace(False))
                
                for faceCount, shdBrep in enumerate(shadingBreps):
                        thisShading = hb_EPSHDSurface(shdBrep, 1000*brepCount + faceCount, 'shdSrf_' + `brepCount` + '_' + `faceCount` + "_" + str(uuid.uuid4()))
                        
                        # add transmittance schedule if any
                        if EPTransSchedule!=None:
                            schedule= EPTransSchedule.upper()
                            if schedule!=None and not schedule.lower().endswith(".csv") and schedule not in HBScheduleList:
                                msg = "Cannot find " + schedule + " in Honeybee schedule library."
                                print msg
                                ghenv.Component.AddRuntimeMessage(gh.GH_RuntimeMessageLevel.Warning, msg)
                                return -1
                            elif schedule!=None and schedule.lower().endswith(".csv"):
                                # check if csv file is existed
                                if not os.path.isfile(schedule):
                                    msg = "Cannot find the shchedule file: " + schedule
                                    print msg
                                    ghenv.Component.AddRuntimeMessage(gh.GH_RuntimeMessageLevel.Warning, msg)
                                    return -1
                            
                            thisShading.TransmittanceSCH = schedule
                        
                        # add the Rad Material if any
                        if RADMaterial!=None:
                            # if it is just the name of the material make sure it is already defined
                            if len(RADMaterial.split(" ")) == 1:
                                # if the material is not in the library add it to the library
                                if not hb_RADMaterialAUX.isMatrialExistInLibrary(RADMaterial):
                                    warningMsg = "Can't find " + RADMaterial + " in RAD Material Library.\n" + \
                                                "Add the material to the library and try again."
                                    ghenv.Component.AddRuntimeMessage(gh.GH_RuntimeMessageLevel.Warning, warningMsg)
                                    return
                                
                                try:
                                    thisShading.setRADMaterial(RADMaterial)
                                except Exception, e:
                                    print e
                                    warningMsg = "You are using an old version of Honeybee_Honeybee! Update your files and try again."
                                    print warningMsg
                                    ghenv.Component.AddRuntimeMessage(gh.GH_RuntimeMessageLevel.Warning, warningMsg)
                                    return
                                
                                addedToLib = True
                            else:
                                
                                # try to add the material to the library
                                addedToLib, thisShading.RadMaterial = hb_RADMaterialAUX.analyseRadMaterials(RADMaterial, True)
                                
                            if addedToLib==False:
                                warningMsg = "Failed to add " + RADMaterial + " to the Library."
                                ghenv.Component.AddRuntimeMessage(gh.GH_RuntimeMessageLevel.Warning, warningMsg)
                                return
                        
                        # add shading to the list
                        shadingClasses.append(thisShading)
                
        # add to the hive
        hb_hive = sc.sticky["honeybee_Hive"]()
        HBContext  = hb_hive.addToHoneybeeHive(shadingClasses, ghenv.Component.InstanceGuid.ToString())
        return HBContext
        ################################################################################################
    else:
        print "You should first let Honeybee to fly..."
        w = gh.GH_RuntimeMessageLevel.Warning
        ghenv.Component.AddRuntimeMessage(w, "You should first let Honeybee to fly...")
        return -1
        

if _shdSurfaces and _shdSurfaces[0]!=None:
    # add cleaning function
    result= main(_shdSurfaces, EPTransSchedule_, meshingSettings_, justBoundingBox_)
    
    if result != -1: HBContext = result
# ---------- end hb_epcontextsrf ----------
hb_epcontextsrf_2 = HoneybeeEPContextSurfaces()  # -> HBContext; inputs shdSurfaces: list of Brep, justBoundingBox: Boolean; disabled; same code as hb_epcontextsrf
createhbzones = Honeybee_createHBZones(name=panel_4, HBSurfaces=flatten(createhbsrfs.HBSurface), isConditioned=toggle_6)  # -> readMe, HBZone; disabled; plug-in component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

# ---- group: Residential
geo_15 = Geometry([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])

# ----
num_2 = Number(3)  # disabled
listzoneprograms_3 = Honeybee_ListZonePrograms(bldgProgram=Slider(2, range=0..100))  # -> MidriseApartmentZonePrograms; plug-in component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
splitmass = Honeybee_SplitBuildingMass(bldgMasses=extr, bldgsFlr2FloorHeights="@3", runIt=Toggle(True))  # -> readMe, splitBldgMasses; plug-in component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
num_3 = Number(4)  # disabled
item_2 = ListItem(List=listzoneprograms, Index=num_2, Wrap=True)  # disabled

# ---- group: Retail
data = Data()  # disabled

# ----
panel_5 = Panel("4")  # disabled
item_3 = ListItem(List=listzoneprograms_2, Index=num_3, Wrap=True)  # disabled

# ---- group: Office
data_2 = Data()  # disabled

# ----
createepground = Honeybee_CreateEPGround(HBZones=createhbzones.HBZone, soilTypeOrMat=panel_5)  # -> HBGrndZones; disabled; plug-in component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
num_4 = Number(9)
geo_16 = Geometry(splitmass.splitBldgMasses)
item_4 = ListItem(List=listzoneprograms_3, Index=num_4, Wrap=True)
toggle_7 = BooleanToggle(True)  # disabled
toggle_8 = BooleanToggle(True)
panel_6 = Panel("2")  # disabled
panel_7 = Panel("2")  # disabled
panel_8 = Panel("window")  # disabled
mass2zone = Honeybee_Masses2Zones(zoneMasses=flatten(data_2), zonePrograms=item_3, isConditioned=True, maxRoofAngle=30, createHBZones=toggle_7)  # -> readMe, HBZones; disabled; plug-in component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
mass2zone_2 = Honeybee_Masses2Zones(
    zoneMasses=flatten(splitmass.splitBldgMasses),
    zonePrograms=item_4,
    isConditioned=True,
    maxRoofAngle=30,
    createHBZones=toggle_8)  # -> readMe, HBZones; plug-in component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
concat = Concatenate(FragmentA=panel_7, FragmentB=panel_8, JoinSeparator=" ")  # disabled
concat_2 = Concatenate(FragmentA=panel_6)  # disabled
concat_3 = Concatenate(FragmentA="2", FragmentB="window", JoinSeparator=" ")
concat_4 = Concatenate(FragmentA="2")
toggle_9 = BooleanToggle(True)  # disabled
panel_9 = Panel("0.3")  # disabled
callfromepconstrlibrary = Honeybee_CallFromEPConstructionLibrary(keywords=concat_2)  # -> ThermMaterials, EPMaterials, EPWindowMaterials, EPConstructions; disabled; plug-in component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
callfromepconstrlibrary_2 = Honeybee_CallFromEPConstructionLibrary(keywords=concat)  # -> ThermMaterials, EPMaterials, EPWindowMaterials, EPConstructions; disabled; plug-in component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
callfromepconstrlibrary_3 = Honeybee_CallFromEPConstructionLibrary(keywords=concat_4)  # -> ThermMaterials, EPMaterials, EPWindowMaterials, EPConstructions; plug-in component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
callfromepconstrlibrary_4 = Honeybee_CallFromEPConstructionLibrary(keywords=concat_3)  # -> ThermMaterials, EPMaterials, EPWindowMaterials, EPConstructions; plug-in component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
solveadjc = Honeybee_SolveAdjacencies(HBZones=flatten(mass2zone.HBZones), removeCurrentAdjc=False, findAdjc=toggle_9)  # -> readMe, HBZonesWADJ; disabled; plug-in component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
solveadjc_2 = Honeybee_SolveAdjacencies(HBZones=flatten(mass2zone_2.HBZones), removeCurrentAdjc=False, findAdjc=Toggle(True))  # -> readMe, HBZonesWADJ; plug-in component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
glzparamlist = Honeybee_GlazingParametersList(northGlzParam=panel_9, westGlzParam=panel_9, southGlzParam=panel_9, eastGlzParam=panel_9)  # -> glzParamList; disabled; plug-in component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
glzparamlist_2 = Honeybee_GlazingParametersList(northGlzParam="0.3", westGlzParam="0.3", southGlzParam="0.3", eastGlzParam="0.3")  # -> glzParamList; plug-in component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
toggle_10 = BooleanToggle(False)  # disabled
item_5 = ListItem(List=callfromepconstrlibrary.EPConstructions, Index=198, Wrap=True)  # disabled
item_6 = ListItem(List=callfromepconstrlibrary_2.EPConstructions, Index=44, Wrap=True)  # disabled
item_7 = ListItem(List=callfromepconstrlibrary_3.EPConstructions, Index=198, Wrap=True)
item_8 = ListItem(List=callfromepconstrlibrary_4.EPConstructions, Index=44, Wrap=True)
panel_10 = Panel(item_6)  # disabled
panel_11 = Panel(item_5)  # disabled
panel_12 = Panel(item_8)
panel_13 = Panel(item_7)
glazingcreator = Honeybee_GlazingBasedOnRatio(HBObjects=solveadjc.HBZonesWADJ, glzRatio=glzparamlist, breakUpWindow=toggle_10, runIt=toggle_7)  # -> readMe, HBObjWGLZ; disabled; plug-in component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
glazingcreator_2 = Honeybee_GlazingBasedOnRatio(HBObjects=solveadjc_2.HBZonesWADJ, glzRatio=glzparamlist_2, breakUpWindow=Toggle(False), runIt=toggle_8)  # -> readMe, HBObjWGLZ; plug-in component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
setepzonecnstr = Honeybee_SetEPZoneConstruction(HBZone=glazingcreator.HBObjWGLZ, wallEPConstruction=item_5, windowEPConstruction=item_6)  # -> simplify(modifiedHBZone); disabled; plug-in component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
setepzonecnstr_2 = Honeybee_SetEPZoneConstruction(HBZone=glazingcreator_2.HBObjWGLZ, wallEPConstruction=item_7, windowEPConstruction=item_8)  # -> simplify(modifiedHBZone); plug-in component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
geo_17 = Geometry(setepzonecnstr)  # disabled
geo_18 = Geometry(setepzonecnstr_2)
data_3 = Data(setepzonecnstr_2)
toggle_11 = BooleanToggle(True)
epoutput = Honeybee_GenerateEPOutput(
    zoneEnergyUse=toggle_11,
    zoneGainsAndLosses=toggle_11,
    zoneComfortMetrics="False",
    comfortMapVariables=toggle_11,
    zoneHVACParams=toggle_11,
    surfaceTempAnalysis=toggle_11,
    surfaceEnergyAnalysis=toggle_11,
    glazingSolarAnalysis=toggle_11,
    timestep="annual")  # -> report, flatten(simulationOutputs); plug-in component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
panel_14 = Panel("C:\Users\vasanthakumars\Desktop\temp_folder")
toggle_12 = BooleanToggle(True)
decomposebytype = Honeybee_DecomposeBasedOnType(HBZone=data_3)  # -> walls, interiorWalls, airWalls, flatten(windows), interiorWindows, skylights, roofs, ceilings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; plug-in component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
wires = BrepWireframe(Brep=[decomposebytype.walls, decomposebytype.floors, decomposebytype.ceilings], Density=-1)
geo_19 = Geometry(decomposebytype.floors)
preview_4 = CustomPreview(Geometry=decomposebytype.windows, Shader=ColourSwatch(SwatchColor=RGB(158, 255, 255)))
preview_5 = CustomPreview(Geometry=wires, Shader=ColourSwatch(SwatchColor=RGBA(0, 0, 0, 122)))
preview_6 = CustomPreview(Geometry=geo_19, Shader=ColourSwatch(SwatchColor=RGBA(181, 181, 181, 122)))

panel_15 = Panel("C:\saeran\master\git\bibil\src\reference\CAN_ON_Toronto.716240_CWEC\CAN_ON_Toronto.716240_CWEC.epw")
panel_16 = Panel("C:\\saeran\\master\\git\\bibil\\src\\reference\\CAN_ON_Toronto.716240_CWEC\\CAN_ON_Toronto.716240_CWEC.epw")
list_8 = ValueList({"dir", "file"}, selected="file")

# ---- group: find directory
bibil_13 = PythonScript(dir=[panel_15, panel_16], type=list_8, run=Toggle(True))  # -> file; inputs dir: list
# ---------- bibil_13: Python ----------
import os

ghenv.Component.Params.Output[0].Name = "null"
ghenv.Component.Params.Output[0].NickName = "null"

if run:
    confirm_dir = None
    for d in dir:
        try:
            if type == "file":
                file = open(d)
                file.close()
            else:
                print os.listdir(d)
            confirm_dir = d
            break
        except Exception as e:
            #print str(e)
            continue
    if confirm_dir != None:
        ghenv.Component.Params.Output[0].Name = type
        ghenv.Component.Params.Output[0].NickName = type
        dir = confirm_dir
        file = confirm_dir
null = None
# ---------- end bibil_13 ----------

# ----
data_4 = Data(bibil_13)

exporttoopenstudio = Honeybee_ExportToOpenStudio(
    epwWeatherFile=panel_15,
    HBZones=flatten(data_3),
    simulationOutputs=flatten(epoutput.simulationOutputs),
    writeOSM=toggle_12,
    runSimulation=toggle_12,
    fileName="section_test")  # -> readMe, osmFileAddress, idfFileAddress, resultsFileAddress, rddFileAddress, studyFolder; plug-in component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
readepsrfresult = Honeybee_ReadEPSurfaceResult(resultFileAddress=exporttoopenstudio.resultsFileAddress)  # -> surfaceIndoorTemp, surfaceOutdoorTemp, surfaceEnergyFlow, opaqueEnergyFlow, glazEnergyFlow, windowTotalSolarEnergy, windowBeamEnergy, windowDiffEnergy, windowTransmissivity, port; plug-in component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
readepresult = Honeybee_ReadEPResult(resultFileAddress=exporttoopenstudio.resultsFileAddress)  # -> totalThermalLoad, thermalLoadBalance, cooling, heating, electricLight, electricEquip, port, port_2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; plug-in component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
colorzones = Honeybee_ColorZonesByEPResult(zoneData=readepresult.thermalLoadBalance, HBZones=flatten(data_3), normalizeByFloorArea=Toggle(True), runIt=Toggle(True))  # -> readMe, zoneColoredMesh, zoneWireFrame, legend, legendBasePt, analysisTitle, zoneBreps, zoneColors, zoneValues, floorNormZoneData; plug-in component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
mesh = Mesh(colorzones.zoneColoredMesh)
geo_20 = Geometry([colorzones.analysisTitle, colorzones.legend])
preview_7 = CustomPreview(Geometry=colorzones.zoneWireFrame, Shader=colorzones.zoneColors)
