# Grasshopper definition bibil_trial_101_solar_envelopes.gh (Grasshopper 0.9.76)
# plug-ins: Python Interpreter

path = FilePath("C:\Users\vasanthakumars\Documents\GitHub\bibil\src\reference\CAN_ON_Toronto.716240_CWEC\CAN_ON_Toronto.716240_CWEC.epw")
importepw = Ladybug_ImportEpw(epwFile=path)  # -> readMe, latitude, location, dryBulbTemperature, dewPointTemperature, relativeHumidity, windSpeed, windDirection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; plug-in component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
# Note: Change this number with caution,
# Increase bounds iterratively.
ladybug = Ladybug_Ladybug()  # -> Vviiiiiiiiiizzz; plug-in component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
number_slider = Slider(9, range=0..10)
number_slider_2 = Slider(21, range=0..100)
number_slider_3 = Slider(9, range=0..10)
number_slider_4 = Slider(21, range=0..100)

# ---- group: solar input curve
geo = Geometry(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)

geo_2 = Geometry(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)

# ----
analysisperiod = Ladybug_AnalysisPeriod(
    fromMonth=number_slider,
    fromDay=number_slider_2,
    fromHour=Slider(8.25, range=0..10),
    toMonth=number_slider,
    toDay=number_slider_2,
    toHour=Slider(17.25, range=0..100))  # -> readMe, analysisPeriod; plug-in component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
analysisperiod_2 = Ladybug_AnalysisPeriod(
    fromMonth=number_slider_3,
    fromDay=number_slider_4,
    fromHour=Slider(8.25, range=0..10),
    toMonth=number_slider_3,
    toDay=number_slider_4,
    toHour=Slider(17.25, range=0..100))  # -> readMe, analysisPeriod; plug-in component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
solarfanbasic = Ladybug_SolarFanBasic(
    boundary=geo,
    location=importepw.location,
    requiredHours=Slider(1, range=0..10),
    height=Slider(175, range=0..1000),
    analysisPeriod=analysisperiod.analysisPeriod)  # -> readMe, solarFan; plug-in component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
solarfan = Ladybug_SolarFan()  # -> readMe, solarFan; disabled; plug-in component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
solarfan_2 = Ladybug_SolarFan()  # -> readMe, solarFan; disabled; plug-in component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
solarfanbasic_2 = Ladybug_SolarFanBasic(
    boundary=geo_2,
    location=importepw.location,
    requiredHours=Slider(1, range=0..10),
    height=Slider(175, range=0..1000),
    analysisPeriod=analysisperiod_2.analysisPeriod)  # -> readMe, solarFan; plug-in component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
material = CreateMaterial(
    Diffuse=ColourSwatch(SwatchColor=RGB(0, 255, 107)),
    Specular=RGB(255, 255, 255),
    Emission=RGB(0, 0, 0),
    Transparency=Slider(0.75, range=0..1),
    Shine=0)
material_2 = CreateMaterial(
    Diffuse=ColourSwatch(SwatchColor=RGB(0, 255, 107)),
    Specular=RGB(255, 255, 255),
    Emission=RGB(0, 0, 0),
    Transparency=Slider(0.75, range=0..1),
    Shine=0)
geo_3 = Geometry(solarfanbasic_2.solarFan)
geo_4 = Geometry(solarfanbasic.solarFan)
preview = CustomPreview(Geometry=solarfanbasic.solarFan, Shader=material)
preview_2 = CustomPreview(Geometry=solarfanbasic_2.solarFan, Shader=material_2)
